# Dynamo graph 02_Place Families.dyn (Dynamo 1.3.2.2480)

family_types = FamilyTypes("RPC Tree - Deciduous:Common Apple - 20'")
select_model_elements = DSModelElementsSelection()  # 2 picked in the model
curves = Element.Curves(select_model_elements)
number = DoubleInput(1)
step_value = DoubleSlider(0.2, range=0..1 step 0.1)
range = Range(end=number, step=step_value, lacing=Longest)
pointAtParameter = Curve.PointAtParameter(curve=curves, param=range, lacing=CrossProduct)
byPoint = FamilyInstance.ByPoint(familyType=family_types, point=pointAtParameter)
geometry = Element.Geometry(byPoint)  # frozen
