# Dynamo graph 04_Wall Warehouse.dyn (Dynamo 1.3.2.2480)

# group: 1. Create a list of all Wall Types
element_types = ElementTypes("WallType")
all_elements_of_type = ElementsOfType(element_types)
count = List.Count(all_elements_of_type)
watch = Watch(all_elements_of_type)

# group: 2. Establish the wall spacing
# note: Use this slider to customize the spacing in the X direction
distance_between_walls = DoubleSlider(5, range=5..15 step 0.5)
sequence = Sequence(amount=count, step=distance_between_walls, lacing=Longest)

# group: 3. Create Points and Lines
number = DoubleInput(0)
# note: Line Start Point
byCoordinates = Point.ByCoordinates(x=sequence, y=number)
wall_length = DoubleInput(15)
# note: Line End Point
byCoordinates_2 = Point.ByCoordinates(x=sequence, y=wall_length)
byStartPointEndPoint = Line.ByStartPointEndPoint(startPoint=byCoordinates, endPoint=byCoordinates_2)

# group: 4. Create a wall for each type
base_level = Levels("Level 1")
top_level = Levels("Level 2")
byCurveAndLevels = Wall.ByCurveAndLevels(byStartPointEndPoint, base_level, top_level, all_elements_of_type)
geometry = Element.Geometry(byCurveAndLevels)  # frozen
