# Dynamo graph 05_Casework Warehouse.dyn (Dynamo 1.3.2.2480)

# group: 1. Get all Casework Types
categories = Categories("Casework")
all_family_types_of_category = Custom[All Family Types Of Category](category=categories)  # Gets all family types/symbols of a given category in the model (does *not *work for system families)
family = FamilyType.Family(all_family_types_of_category)
groupByKey = List.GroupByKey(list=all_family_types_of_category, keys=family)
watch = Watch(groupByKey.groups)

# group: 2. Get Type Widths
string = StringInput("Width")
getParameterValueByName = Element.GetParameterValueByName(element=groupByKey.groups, parameterName=string)

# group: 3. Determine X Spacings
number = DoubleInput(0)
x_spacing = DoubleSlider(1, range=1..10 step 0.5)
add = getParameterValueByName + x_spacing
addItemToFront = List.AddItemToFront(item=number, list=add@L2)
number_2 = DoubleInput(-1)
dropItems = List.DropItems(list=addItemToFront@L2, amount=number_2)
lunchbox_mass_addition = Custom[LunchBox Mass Addition](Numbers=dropItems@L2)  # Returns the total value of a list of numbers.
watch_2 = Watch(lunchbox_mass_addition.Partials)

# group: 4. Determine Y Spacings
number_3 = DoubleInput(0)
count = List.Count(groupByKey.groups)
number_4 = DoubleInput(1)
sub = count - number_4
y_spacing = DoubleSlider(4, range=4..10 step 0.5)

range = Range(start=number_3, end=sub, lacing=Longest)

# group (continued): 4. Determine Y Spacings
mul = range * y_spacing

# group: 5. Place Families
byCoordinates = Point.ByCoordinates(x=lunchbox_mass_addition.Partials, y=mul)
byPoint = FamilyInstance.ByPoint(familyType=groupByKey.groups, point=byCoordinates)
