# Dynamo graph 06_SpaceParameters_get.dyn (Dynamo 1.3.2.2480)

# group: Import from Excel
file_path = Filename(".\06_SpaceParameters_get.xlsx")
fromPath = FileObject(file_path)  # "File.FromPath"
code_block = CodeBlock { "Sheet1"; }
readFromFile = Excel.ReadFromFile(file=fromPath, sheetName=code_block)

# group: Get Spaces and Parameters
flatten = Flatten(readFromFile)
categories = Categories("MEPSpaces")
all_elements_of_category = ElementsOfCategory(categories)
getParameterValueByName = Element.GetParameterValueByName(element=all_elements_of_category, parameterName=flatten, lacing=CrossProduct)

# group: Export to Excel
file_path_2 = Filename(".\Player_Export")
code_block_2 = CodeBlock { "Sheet1"; }
code_block_3 = CodeBlock { 0; }
addItemToFront = List.AddItemToFront(item=flatten, list=getParameterValueByName)
writeToFile = Excel.WriteToFile(filePath=file_path_2, sheetName=code_block_2, startRow=code_block_3, startCol=code_block_3, data=addItemToFront)
