# Dynamo graph 08_Curtain Wall Edges.dyn (Dynamo 1.3.2.2480)

# group: 1. Select Irregular Curtain Panels
family_at_irregular_edges = FamilyTypes("System Panel:Solid (Red)")
all_elements_of_family_type = ElementsOfFamilyType(family_at_irregular_edges)

string = StringInput("Family and Type")
replace_with_family = FamilyTypes("Empty System Panel:Empty")
setParameterByName = Element.SetParameterByName(element=all_elements_of_family_type, parameterName=string, value=replace_with_family)

# group: 2. Trace Panels and Find Items with more than Four Edges
boundaries = CurtainPanel.Boundaries(setParameterByName)
flatten = Flatten(boundaries)
numberOfCurves = PolyCurve.NumberOfCurves(flatten)
number = DoubleInput(4)
eq = numberOfCurves == number
filterByBoolMask = List.FilterByBoolMask(list=flatten, mask=eq)

# group: 3. Convert PolyCurves of greater than 4 points to only 4 points
explode = Geometry.Explode(filterByBoolMask.out)
endPoint = Curve.EndPoint(explode)
startPoint = Curve.StartPoint(explode)
number_2 = DoubleInput(-1)
shiftIndices = List.ShiftIndices(list=endPoint@L2, amount=number_2)
byStartPointEndPoint = Line.ByStartPointEndPoint(startPoint=startPoint, endPoint=shiftIndices)
doesIntersect = Geometry.DoesIntersect(geometry=byStartPointEndPoint, other=endPoint)
filterByBoolMask_2 = List.FilterByBoolMask(list=endPoint, mask=doesIntersect)

# group: 4. Existing 4 point PolyCurves
explode_2 = Geometry.Explode(filterByBoolMask.in)
startPoint_2 = Curve.StartPoint(explode_2)

base_point_y = DoubleInput(0)

# group: 5. Rearrange the order of the points
join = List.Join(filterByBoolMask_2.out, startPoint_2)
number_3 = DoubleInput(-1)
base_point_x = DoubleInput(-100)
byCoordinates = Point.ByCoordinates(x=base_point_x, y=base_point_y)
distanceTo = Geometry.DistanceTo(geometry=join, other=byCoordinates)
minimumItem = List.MinimumItem(distanceTo)
indexOf = IndexOf(distanceTo@L2, minimumItem@L1)
mul = number_3 * indexOf
shiftIndices_2 = List.ShiftIndices(list=join@L2, amount=mul@L1)

# group: 6. Create Adaptive Components
adaptive_component_panel = FamilyTypes("_Nested SSG:Standard")
byPoints = AdaptiveComponent.ByPoints(points=shiftIndices_2, familyType=adaptive_component_panel)

watch = Watch(filterByBoolMask_2.out)
watch_2 = Watch(startPoint_2)
watch_3 = Watch()  # unwired: arg0
