# Dynamo graph 01_Hello Wall_B.dyn (Dynamo 2.0.1.5055)

number = DoubleInput(0)  # graph input
number_2 = DoubleInput(0)  # graph input
byCoordinates = Point.ByCoordinates(x=number, y=number_2)
string = StringInput("Hello ")  # graph input
string_2 = StringInput("World")  # graph input
add = string + string_2
watch = Watch(add)
