# Dynamo graph 01_Hello Wall_C.dyn (Dynamo 2.0.1.5055)

number = DoubleInput(0)  # graph input
number_2 = DoubleInput(0)  # graph input
byCoordinates = Point.ByCoordinates(x=number, y=number_2)
number_3 = DoubleInput(0)  # graph input
number_4 = DoubleInput(0)  # graph input
add = number_3 + number_4
watch = Watch(add)
string = StringInput("Hello ")  # graph input
string_2 = StringInput("World")  # graph input
