# Dynamo graph 01_Hello Wall_E.dyn (Dynamo 2.0.1.5055)

number = DoubleInput(0)  # graph input
number_2 = DoubleInput(0)  # graph input
byCoordinates = Point.ByCoordinates(x=number, y=number_2)
number_3 = DoubleInput(0)  # graph input
number_4 = DoubleInput(0)  # graph input
byCoordinates_2 = Point.ByCoordinates(x=number_3, y=number_4)
byStartPointEndPoint = Line.ByStartPointEndPoint(startPoint=byCoordinates, endPoint=byCoordinates_2)
