# Dynamo graph 01_Hello Wall_G.dyn (Dynamo 2.0.1.5055)

number = DoubleInput(1)  # graph input
number_2 = DoubleInput(2)  # graph input
byCoordinates = Point.ByCoordinates(x=number, y=number_2)
number_3 = DoubleInput(1)  # graph input
number_4 = DoubleInput(15)  # graph input
byCoordinates_2 = Point.ByCoordinates(x=number_3, y=number_4)
byStartPointEndPoint = Line.ByStartPointEndPoint(startPoint=byCoordinates, endPoint=byCoordinates_2)
levels = Levels(index=0)  # graph input
levels_2 = Levels(index=1)  # graph input
wall_types = WallTypes(index=16)  # graph input
byCurveAndLevels = Wall.ByCurveAndLevels(c=byStartPointEndPoint, startLevel=levels, endLevel=levels_2, wallType=wall_types)
geometry = Element.Geometry(element=byCurveAndLevels)
string = StringInput("Comments")
string_2 = StringInput("Hello World")
setParameterByName = Element.SetParameterByName(element=byCurveAndLevels, parameterName=string, value=string_2)
