# Dynamo graph 01_Hello Wall.dyn (Dynamo 1.3.1.1736)

start_x_coordinate = DoubleInput(0)
start_y_coordinate = DoubleInput(0)
byCoordinates = Point.ByCoordinates(x=start_x_coordinate, y=start_y_coordinate)
end_x_coordinate = DoubleInput(0)
end_y_coordinate = DoubleInput(15)
byCoordinates_2 = Point.ByCoordinates(x=end_x_coordinate, y=end_y_coordinate)
byStartPointEndPoint = Line.ByStartPointEndPoint(startPoint=byCoordinates, endPoint=byCoordinates_2)
base_level = Levels("Level 1")
top_level = Levels("Level 2")
wall_types = WallTypes("Generic - 8\"")
byCurveAndLevels = Wall.ByCurveAndLevels(byStartPointEndPoint, base_level, top_level, wall_types)
geometry = Element.Geometry(byCurveAndLevels)
string = StringInput("Comments")
value_of_comments = StringInput("Hello World")
setParameterByName = Element.SetParameterByName(element=byCurveAndLevels, parameterName=string, value=value_of_comments)
code_block = CodeBlock { "Comments"; }
