# Dynamo graph 02_Place Families_A.dyn (Dynamo 2.0.1.5055)

family_types = FamilyTypes()  # nothing selected; graph input
select_model_element = DSModelElementSelection()  # nothing selected; graph input
curves = Element.Curves(element=select_model_element)
number = DoubleInput(0)  # graph input
pointAtParameter = Curve.PointAtParameter(curve=curves, param=number)
byPoint = FamilyInstance.ByPoint(familyType=family_types, point=pointAtParameter)
number_slider = DoubleSlider(1, range=0..100 step 0.1)  # graph input
