# Dynamo graph 02_Place Families_B.dyn (Dynamo 1.3.1.1736)

family_types = FamilyTypes("RPC Tree - Deciduous:Common Apple - 20'")
select_model_element = DSModelElementSelection()  # 1 picked in the model
curves = Element.Curves(select_model_element)
number = DoubleInput(0)
pointAtParameter = Curve.PointAtParameter(curve=curves, param=number)
byPoint = FamilyInstance.ByPoint(familyType=family_types, point=pointAtParameter)
number_slider = DoubleSlider(1, range=0..100 step 0.1)
