# Dynamo graph 02_Place Families_D.dyn (Dynamo 1.3.1.1736)

select_model_element = DSModelElementSelection()  # 1 picked in the model
family_types = FamilyTypes("RPC Tree - Deciduous:Common Apple - 20'")
select_model_elements = DSModelElementsSelection()  # 2 picked in the model
curves = Element.Curves(select_model_elements)
number = DoubleInput(1)
number_slider = DoubleSlider(0.1, range=0..1 step 0.1)
range = Range(end=number, step=number_slider, lacing=Longest)
pointAtParameter = Curve.PointAtParameter(curve=curves, param=range)
byPoint = FamilyInstance.ByPoint(familyType=family_types, point=pointAtParameter)
geometry = Element.Geometry(byPoint)
