# Dynamo graph 03_Wall Warehouse_A.dyn (Dynamo 1.3.1.1736)

number = DoubleInput(1)
number_2 = DoubleInput(2)
byCoordinates = Point.ByCoordinates(x=number, y=number_2)
number_3 = DoubleInput(1)
number_4 = DoubleInput(15)
byCoordinates_2 = Point.ByCoordinates(x=number_3, y=number_4)
byStartPointEndPoint = Line.ByStartPointEndPoint(startPoint=byCoordinates, endPoint=byCoordinates_2)
levels = Levels("Level 1")
levels_2 = Levels("Level 2")
wall_types = WallTypes("Generic - 8\"")
byCurveAndLevels = Wall.ByCurveAndLevels(byStartPointEndPoint, levels, levels_2, wall_types)
geometry = Element.Geometry(byCurveAndLevels)
string = StringInput("Comments")
string_2 = StringInput("Hello World")
setParameterByName = Element.SetParameterByName(element=byCurveAndLevels, parameterName=string, value=string_2)
