# Dynamo graph 03_Wall Warehouse_B.dyn (Dynamo 1.3.2.2480)

# group: 3. Create Points and Lines
number = DoubleInput(0)
# note: Line Start Point
byCoordinates = Point.ByCoordinates(y=number)
number_2 = DoubleInput(15)
# note: Line End Point
byCoordinates_2 = Point.ByCoordinates(y=number_2)
byStartPointEndPoint = Line.ByStartPointEndPoint(startPoint=byCoordinates, endPoint=byCoordinates_2)

# group: 4. Create a wall for each type
levels = Levels("Level 1")
levels_2 = Levels("Level 2")
wall_types = WallTypes("Generic - 8\"")
byCurveAndLevels = Wall.ByCurveAndLevels(byStartPointEndPoint, levels, levels_2, wall_types)
geometry = Element.Geometry(byCurveAndLevels)
