# Dynamo graph 03_Wall Warehouse_D.dyn (Dynamo 1.3.1.1736)

# group: 1. Create a list of all Wall Types
element_types = ElementTypes("WallType")
all_elements_of_type = ElementsOfType(element_types)
count = List.Count(all_elements_of_type)
watch = Watch(all_elements_of_type)

# group: 2. Establish the wall spacing
# note: Use this slider to customize the spacing in the X direction
number_slider = DoubleSlider(5, range=5..15 step 0.5)
sequence = Sequence(amount=count, step=number_slider, lacing=Longest)

# group: 3. Create Points and Lines
number = DoubleInput(0)
# note: Line Start Point
byCoordinates = Point.ByCoordinates(x=sequence, y=number)
number_2 = DoubleInput(15)
# note: Line End Point
byCoordinates_2 = Point.ByCoordinates(x=sequence, y=number_2)
byStartPointEndPoint = Line.ByStartPointEndPoint(startPoint=byCoordinates, endPoint=byCoordinates_2)

# group: 4. Create a wall for each type
levels = Levels("Level 1")
levels_2 = Levels("Level 2")
byCurveAndLevels = Wall.ByCurveAndLevels(byStartPointEndPoint, levels, levels_2, all_elements_of_type)
geometry = Element.Geometry(byCurveAndLevels)
