# Dynamo graph 04_Casework Warehouse_B.dyn "05_Casework Warehouse_B" (Dynamo 2.0.1.5055)

# group: 1. Get all Casework Types
categories = Categories(index=106)  # graph input
# note: Requires the Clockwork version 2.x Package
all_family_types_of_category = Custom[All Family Types Of Category](category=categories)  # Gets all family types/symbols of a given category in the model.
family = FamilyType.Family(familyType=all_family_types_of_category)
groupByKey = List.GroupByKey(list=all_family_types_of_category, keys=family)
watch = Watch(groupByKey.groups)

# group: 5. Place Families
byCoordinates = Point.ByCoordinates()
byPoint = FamilyInstance.ByPoint(familyType=groupByKey.groups, point=byCoordinates)
