# Dynamo graph 04_Casework Warehouse_E.dyn "05_Casework Warehouse_E" (Dynamo 2.0.1.5055)

# group: 1. Get all Casework Types
categories = Categories(index=106)  # graph input
# note: Requires the Clockwork version 2.x Package
all_family_types_of_category = Custom[All Family Types Of Category](category=categories)  # Gets all family types/symbols of a given category in the model.
family = FamilyType.Family(familyType=all_family_types_of_category)
groupByKey = List.GroupByKey(list=all_family_types_of_category, keys=family)
watch = Watch(groupByKey.groups)

# group: 2. Get Type Widths
string = StringInput("Width")
getParameterValueByName = Element.GetParameterValueByName(element=groupByKey.groups, parameterName=string)

# group: 3. Determine X Spacings
number = DoubleInput(0)
number_slider = DoubleSlider(1, range=1..10 step 0.5)
add = getParameterValueByName + number_slider
addItemToFront = List.AddItemToFront(item=number, list=add@L2)
number_2 = DoubleInput(-1)
dropItems = List.DropItems(list=addItemToFront@L2, amount=number_2)
# note: Requires Lunchbox
lunchbox_mass_addition = Custom[LunchBox Mass Addition](Numbers=dropItems@L2)  # Returns the total value of a list of numbers.
watch_2 = Watch(lunchbox_mass_addition.Partials)

# group: 4. Determine Y Spacings
number_3 = DoubleInput(0)
count = List.Count(list=groupByKey.groups)
number_4 = DoubleInput(1)
sub = count - number_4
range = Range(start=number_3, end=sub)
number_slider_2 = DoubleSlider(4, range=4..10 step 0.5)
mul = range * number_slider_2

# group: 5. Place Families
byCoordinates = Point.ByCoordinates(x=lunchbox_mass_addition.Partials, y=mul)
byPoint = FamilyInstance.ByPoint(familyType=groupByKey.groups, point=byCoordinates)
