# Dynamo graph 05_SpaceParameters_get_A.dyn (Dynamo 2.0.1.5055)

# group: 1. Import from Excel
file_path = Filename(".\05_SpaceParameters_get.xlsx")
file_from_path = FileObject(path=file_path)
code_block = CodeBlock { "Sheet1"; }
importExcel = Data.ImportExcel(file=file_from_path, sheetName=code_block)
