# Dynamo graph 05_SpaceParameters_get_B.dyn (Dynamo 2.0.1.5055)

# group: 1. Import from Excel
file_path = Filename(".\05_SpaceParameters_get.xlsx")
file_from_path = FileObject(path=file_path)
code_block = CodeBlock { "Sheet1"; }
importExcel = Data.ImportExcel(file=file_from_path, sheetName=code_block)

# group: 2. Get Spaces and Parameters
categories = Categories(index=457)
all_elements_of_category = ElementsOfCategory(Category=categories)
flatten = List.Flatten(list=importExcel)
getParameterValueByName = Element.GetParameterValueByName(element=all_elements_of_category, parameterName=flatten, lacing=CrossProduct)
