# Dynamo graph 05_SpaceParameters_get_C.dyn (Dynamo 2.0.1.5055)

# group: 1. Import from Excel
file_path = Filename(".\05_SpaceParameters_get.xlsx")
file_from_path = FileObject(path=file_path)
code_block = CodeBlock { "Sheet1"; }
importExcel = Data.ImportExcel(file=file_from_path, sheetName=code_block)

# group: 2. Get Spaces and Parameters
categories = Categories(index=457)
all_elements_of_category = ElementsOfCategory(Category=categories)
flatten = List.Flatten(list=importExcel)
getParameterValueByName = Element.GetParameterValueByName(element=all_elements_of_category, parameterName=flatten, lacing=CrossProduct)

file_path_2 = Filename(".\05_SpaceValues_export.xlsx")
code_block_2 = CodeBlock { "Sheet1"; }
code_block_3 = CodeBlock { 0; }
exportExcel = Data.ExportExcel(filePath=file_path_2, sheetName=code_block_2, startRow=code_block_3, startCol=code_block_3)  # unwired: data
addItemToFront = List.AddItemToFront()  # unwired: item, list
