# Dynamo graph 06_SpaceParameters_set_!Start.dyn (Dynamo 2.0.1.5055)

# group: 1. Import from Excel
file_path = Filename(".\06_SpaceValues_set.xlsx")  # graph input
fromPath = FileObject(path=file_path)  # "File.FromPath"
code_block = CodeBlock { "Sheet1"; }
importExcel = Data.ImportExcel(file=fromPath, sheetName=code_block)

# group: 3. Get Spaces and Set Parameters
categories = Categories(index=457)  # graph input
all_elements_of_category = ElementsOfCategory(Category=categories)
setParameterByName = Element.SetParameterByName(element=all_elements_of_category)  # unwired: parameterName, value
