# Dynamo graph 06_SpaceParameters_set_A.dyn (Dynamo 2.0.1.5055)

# group: 1. Import from Excel
file_path = Filename(".\06_SpaceValues_set.xlsx")  # graph input
fromPath = FileObject(path=file_path)  # "File.FromPath"
code_block = CodeBlock { "Sheet1"; }
importExcel = Data.ImportExcel(file=fromPath, sheetName=code_block)

# group: 2. Extract data required
code_block_2 = CodeBlock { 3; }
getItemAtIndex = List.GetItemAtIndex(list=importExcel@L2, index=code_block_2)
restOfItems = List.RestOfItems(list=getItemAtIndex)

# group: 3. Get Spaces and Set Parameters
categories = Categories(index=457)  # graph input
all_elements_of_category = ElementsOfCategory(Category=categories)
code_block_3 = CodeBlock { "Specified Supply Airflow"; }
setParameterByName = Element.SetParameterByName(element=all_elements_of_category, parameterName=code_block_3, value=restOfItems)
