# Dynamo graph 07_RoomOccupancies.dyn (Dynamo 2.0.1.5055)

# group: Room Occupancies
# note: Graph Courtesy of:
# Sol Amour     twitter: @solamour
# Mark Thorley     twitter: @MarkThorley1

# group: 1. Select Rooms
# note: Categories node. This refers to all categories inside of Revit (Such as Doors, Walls, Columns, Ducts etc)
categories = Categories(index=425)  # graph input
# note: This node collects all elements (Inside a Revit project) of the chosen Category.
all_elements_of_category = ElementsOfCategory(Category=categories)
watch = Watch(all_elements_of_category)

# group: 1A. List all Parameters
# note: This node will take an Element and query every single parameter it has and give a list that showcases the data in the following way: 'ParameterName : ParameterValue'
# This can be a good way to see what parameters are available when building a graph
parameters = Element.Parameters(element=all_elements_of_category)
watch_2 = Watch(parameters)

# group: 2. Filter Rooms by Name
# note: The String here has the name of the parameter we want to extract
string = StringInput("Name")
getParameterValueByName = Element.GetParameterValueByName(element=all_elements_of_category, parameterName=string)
watch_3 = Watch(getParameterValueByName)
# note: This String has the name of the rooms we are looking for.
# note: We use an equality comparison here to see if our Room Names match our chosen room (Instruction). This will result in either a True or a False.
string_2 = StringInput("Instruction")
eq = getParameterValueByName == string_2
# note: The list comes from our original selction of rooms in the model. The True and False values split the list into two list. The ones whose values are true will go to the "in" port, False values will go to the "out" port.
filterByBoolMask = List.FilterByBoolMask(list=all_elements_of_category, mask=eq)
watch_4 = Watch(filterByBoolMask.in)
# note: Watch nodes is a nice way to see the output of each port separately.
watch_5 = Watch(filterByBoolMask.out)

string_3 = StringInput("Occupancy")
number = DoubleInput(1.86)

# group: 3. Calculate occupancy value
string_4 = StringInput("Area")
# note: From our filtered list ("in" values only) query the Area of each Room.
getParameterValueByName_2 = Element.GetParameterValueByName(element=filterByBoolMask.in, parameterName=string_4)
# note: We use a Division node here to divide our Room Areas by a chosen value. Check your local building code.
div = getParameterValueByName_2 / number
# note: This node is a mathematical operation that rounds down (floors) the value.
floor = Math.Floor(number=div)

# group: 4. Set Parameter in Model
# note: The value input for 'Occupancy' requries text only - so we run into error if we try to feed the calculated numbers directly. This node converts the numbers to text.
string_from_object = FromObject(obj=floor)
# note: This node writes the values back to the Revit model.
setParameterByName = Element.SetParameterByName(element=filterByBoolMask.in, parameterName=string_3, value=string_from_object)  # frozen
