# Dynamo graph 08_Structural_Truss from Shops.dyn (Dynamo 1.3.2.2480)

# group: 1. Get all lines from CAD file's "members" Layer
# note: ***START HERE***
# UN-FREEZE notes are included above each group to indicate where the frozen nodes are. The frozen nodes are grayed out with a dashed border around them. Run the graph. After you understand the first group, right-click the frozen node in the next group and run again. Repeat until you have completed the graph.
# Use Preview Bubbles and Watch nodes along the way to understand each piece.
element_types = ElementTypes("ImportInstance")
all_elements_of_type = ElementsOfType(element_types)
curvesFromCADLayers = CAD.CurvesFromCADLayers(all_elements_of_type)
# note: must flatten due to unwanted extra list structures
flatten = Flatten(curvesFromCADLayers.out0)

# group: 2. long sides of truss memebers only, filter out end pieces & mitred corners
# note: get the length of every line from CAD
# note: UN-FREEZE
length = Curve.Length(flatten)  # frozen
# note: we know the smallest profile edge
# of a 2x6 board is 2" nominal, then convert
# Inches to Feet
code_block = CodeBlock { 2/12; }
# note: test if each line is Greater Than 2"
gt = length > code_block
# note: filter (in) all lines that are greater than 2" (true)
filterByBoolMask = List.FilterByBoolMask(list=flatten, mask=gt)
watch = Watch(filterByBoolMask.in)

# group: 3. group parallel lines of truss members
code_block_2 = CodeBlock { 0.5; }
# note: get the midpoint of every line
# note: UN-FREEZE
pointAtParameter = Curve.PointAtParameter(curve=filterByBoolMask.in, param=code_block_2)  # frozen
# note: create a vector between EVERY midpoint
# using Longest lacing (xxx)
# *PURPOSE: in theory we can use the shortest
# vectors to identify which lines are closest &
# group them in pairs
# note: See the Bonus file named:
# 10_04_Intro to Vectors.dyn
byTwoPoints = Vector.ByTwoPoints(start=pointAtParameter, end=pointAtParameter, lacing=CrossProduct)
# note: get length of every vector > will
# get 0s where points attempt to
# create a vector with self
length_2 = Vector.Length(byTwoPoints)
# note: once again the default units are Feet
# & we know the widest profile width
# of a 2x6 board is 2", so must convert
# Inches to Feet
code_block_3 = CodeBlock { 2/12; }
# note: test if each vector is Less Than 2"
lt = length_2 < code_block_3
# note: since we tested EVERY midpoint against EVERY midpoint, we must now filter (in) the vectors from each sublist that have are shorter than 2" (true)
filterByBoolMask_2 = List.FilterByBoolMask(list=filterByBoolMask.in, mask=lt@L2)
watch_2 = Watch(filterByBoolMask_2.in)

# group: 4. eliminate duplicate lines from list
# note: creating a vector between EVERY
# point earlier means that we end
# up with TWO pairs of the same lines.
# Start by flattening the list...
# note: UN-FREEZE
flatten_2 = Flatten(filterByBoolMask_2.in)  # frozen
# note: remove duplicate items
# & keep only one of each line
uniqueItems = List.UniqueItems(flatten_2)
code_block_4 = CodeBlock { 2; }
# note: re-structure into pairs of parallel lines
chop = List.Chop(list=uniqueItems, lengths=code_block_4)

# group: 5. establish center lines by translating a line from one side of each pair halfway to the other side
code_block_5 = CodeBlock { 0.5; }
# note: get the midpoint of every line
# note: UN-FREEZE
pointAtParameter_2 = Curve.PointAtParameter(curve=chop, param=code_block_5)  # frozen
# note: get the Z-height of every point > looking
# for the LOWEST line from every pair
Z = Point.Z(pointAtParameter_2)
# note: sort all sub-lists of Lines by lowest z-height
# value first
sortByKey = List.SortByKey(list=chop@L2, keys=Z@L2)
# note: extract all of the last items in each
#  sublist > which is actually the
# HIGHEST item
lastItem = List.LastItem(sortByKey.sorted_list@L2)
# note: sort all sub-lists of Points by lowest z-height
# value first
sortByKey_2 = List.SortByKey(list=pointAtParameter_2@L2, keys=Z@L2)
# note: extract all of the last items in each
# sublist > which is actually the
# HIGHEST item
lastItem_2 = List.LastItem(sortByKey_2.sorted_list@L2)
# note: extract all of the first items in each
# sublist > which is the LOWEST item
firstItem = List.FirstItem(sortByKey_2.sorted_list@L2)
# note: create a vector in the direction of
# the highest line to lowest line
byTwoPoints_2 = Vector.ByTwoPoints(start=lastItem_2, end=firstItem)
code_block_6 = CodeBlock { 0.5; }
# note: reduce the vector to HALF as long
scale = Vector.Scale(vector=byTwoPoints_2, scale_factor=code_block_6)
# note: move each higher line halfway towards
# the second line in each sublist pair
translate = Geometry.Translate(geometry=lastItem@L1, direction=scale@L1)

# group: 6. populate Dimensional Lumber family in Revit
levels = Levels("Ref. Level")
structural_framing_types = StructuralFramingTypes("2x6")
# note: UN-FREEZE
beamByCurve = StructuralFraming.BeamByCurve(curve=translate, level=levels, structuralFramingType=structural_framing_types)  # frozen

# group: 7. re-justify truss member families for horizontal & vertical center
code_block_7 = CodeBlock { "y Justification"; "z Justification"; }
# note: Set to 1 (int) for Center justification
# [figured this out through trial-and-
# error in Revit]
code_block_8 = CodeBlock { 1; }
# note: UN-FREEZE
setParameterByName = Element.SetParameterByName(element=beamByCurve, parameterName=code_block_7.out0, value=code_block_8)  # frozen
setParameterByName_2 = Element.SetParameterByName(element=setParameterByName, parameterName=code_block_7.out1, value=code_block_8)

# group: 8. rotate each truss member family to horizontal configuration
code_block_9 = CodeBlock { "Cross-Section Rotation"; }
code_block_10 = CodeBlock { 90; }
# note: UN-FREEZE
setParameterByName_3 = Element.SetParameterByName(element=setParameterByName_2, parameterName=code_block_9, value=code_block_10)  # frozen

watch_3 = Watch(curvesFromCADLayers.out1)
watch_4 = Watch()  # unwired: arg0
