# Dynamo graph 09_Curtain Wall Edges_A.dyn (Dynamo 1.3.1.1736)

# group: 1. Select Irregular Curtain Panels
family_types = FamilyTypes("Empty System Panel:Empty")
all_elements_of_family_type = ElementsOfFamilyType(family_types)

# group: 6. Create Adaptive Components
family_types_2 = FamilyTypes()
byPoints = AdaptiveComponent.ByPoints(familyType=family_types_2)  # unwired: points
