# Dynamo graph 09_Curtain Wall Edges_C.dyn (Dynamo 1.3.1.1736)

# group: 6. Create Adaptive Components
family_types = FamilyTypes()
byPoints = AdaptiveComponent.ByPoints(familyType=family_types)  # unwired: points

# group: 1. Select Irregular Curtain Panels
family_types_2 = FamilyTypes("Empty System Panel:Empty")
all_elements_of_family_type = ElementsOfFamilyType(family_types_2)

# group: 2. Trace Panels and Find Items with more than Four Edges
boundaries = CurtainPanel.Boundaries(all_elements_of_family_type)
flatten = Flatten(boundaries)
numberOfCurves = PolyCurve.NumberOfCurves(flatten)
number = DoubleInput(4)
eq = numberOfCurves == number
filterByBoolMask = List.FilterByBoolMask(list=flatten, mask=eq)

watch = Watch(filterByBoolMask.out)
watch_2 = Watch(filterByBoolMask.in)
watch_3 = Watch()  # unwired: arg0

# group: 3. Convert PolyCurves of greater than 4 points to only 4 points
explode = Geometry.Explode(filterByBoolMask.out)
endPoint = Curve.EndPoint(explode)
startPoint = Curve.StartPoint(explode)
number_2 = DoubleInput(-1)
shiftIndices = List.ShiftIndices(list=endPoint@L2, amount=number_2)
byStartPointEndPoint = Line.ByStartPointEndPoint(startPoint=startPoint, endPoint=shiftIndices)
doesIntersect = Geometry.DoesIntersect(geometry=byStartPointEndPoint, other=endPoint)
filterByBoolMask_2 = List.FilterByBoolMask(list=endPoint, mask=doesIntersect)

watch_4 = Watch(filterByBoolMask_2.out)
watch_5 = Watch()  # unwired: arg0
