# Dynamo graph 09_Curtain Wall Edges_F.dyn (Dynamo 1.3.1.1736)

# group: 6. Create Adaptive Components
family_types = FamilyTypes()
byPoints = AdaptiveComponent.ByPoints(familyType=family_types)  # unwired: points

# group: 1. Select Irregular Curtain Panels
family_types_2 = FamilyTypes("Empty System Panel:Empty")
all_elements_of_family_type = ElementsOfFamilyType(family_types_2)

# group: 2. Trace Panels and Find Items with more than Four Edges
boundaries = CurtainPanel.Boundaries(all_elements_of_family_type)
flatten = Flatten(boundaries)
numberOfCurves = PolyCurve.NumberOfCurves(flatten)
number = DoubleInput(4)
eq = numberOfCurves == number
filterByBoolMask = List.FilterByBoolMask(list=flatten, mask=eq)

# group: 3. Convert PolyCurves of greater than 4 points to only 4 points
explode = Geometry.Explode(filterByBoolMask.out)
endPoint = Curve.EndPoint(explode)
startPoint = Curve.StartPoint(explode)
number_2 = DoubleInput(-1)
shiftIndices = List.ShiftIndices(list=endPoint@L2, amount=number_2)
byStartPointEndPoint = Line.ByStartPointEndPoint(startPoint=startPoint, endPoint=shiftIndices)
doesIntersect = Geometry.DoesIntersect(geometry=byStartPointEndPoint, other=endPoint)
filterByBoolMask_2 = List.FilterByBoolMask(list=endPoint, mask=doesIntersect)

watch = Watch(filterByBoolMask_2.out)

# group: 4. Existing 4 point PolyCurves
explode_2 = Geometry.Explode(filterByBoolMask.in)
startPoint_2 = Curve.StartPoint(explode_2)

watch_2 = Watch(startPoint_2)

# group: 5. Rearrange the order of the points
join = List.Join(filterByBoolMask_2.out, startPoint_2)
number_3 = DoubleInput(-1)
number_4 = DoubleInput(-100)
byCoordinates = Point.ByCoordinates(x=number_4)
distanceTo = Geometry.DistanceTo(geometry=join, other=byCoordinates)
minimumItem = List.MinimumItem(distanceTo)
indexOf = IndexOf(distanceTo@L2, minimumItem@L1)
mul = number_3 * indexOf
shiftIndices_2 = List.ShiftIndices(list=join@L2, amount=mul@L1)

watch_3 = Watch(join)
