# Dynamo graph 10_01_NumberRangesAndSequences.dyn (Dynamo 1.3.2.2480)

# group: Number Sequence with Nodes
number = DoubleInput(0)
number_2 = DoubleInput(10)
number_3 = DoubleInput(2)
sequence = Sequence(start=number, amount=number_2, step=number_3, lacing=Longest)
watch = Watch(sequence)

# group: Number Range with Nodes
number_4 = DoubleInput(0)
number_5 = DoubleInput(10)
number_6 = DoubleInput(1)
range = Range(start=number_4, end=number_5, step=number_6, lacing=Longest)
watch_2 = Watch(range)

# group: Number Sequence with Code Blocks
# note: start..#amount..step
code_block = CodeBlock { 0..#10..2; }
watch_3 = Watch(code_block)
# note: start..end..#amount
code_block_2 = CodeBlock { 0..10..#2; }
watch_4 = Watch(code_block_2)

# group: Number Range with Code Blocks
# note: start..end..step
code_block_3 = CodeBlock { 0..10..1; }
watch_5 = Watch(code_block_3)
# note: start..end..(default step = 1)
code_block_4 = CodeBlock { 0..10; }
watch_6 = Watch(code_block_4)

# group: Nested Number Ranges/Sequences
# note: start..end..step
code_block_5 = CodeBlock { 0..10..(1..2); }
watch_7 = Watch(code_block_5)
# note: start..#amount..interval
code_block_6 = CodeBlock { 0..#({2,5})..10; }
watch_8 = Watch(code_block_6)

# group: Define Variables
# note: Use text to define a variable input
integer_slider = IntegerSlider(11, range=5..20 step 1)
code_block_7 = CodeBlock(num=integer_slider) { 0..20..#num; }
watch_9 = Watch(code_block_7)

# group: Sequence with Variable inputs
number_7 = DoubleInput(10)
number_slider = DoubleSlider(5, range=0..15 step 0.1)
code_block_8 = CodeBlock(Quan=number_7, Spc=number_slider) { 0..#Quan..Spc; }
watch_10 = Watch(code_block_8)
