# Dynamo graph 10_02_ListLacing.dyn (Dynamo 1.3.2.2480)

# group: List Lacing - Shortest
code_block = CodeBlock { 0..60..10; 0; }
byCoordinates = Point.ByCoordinates(x=code_block.out0, y=code_block.out1)
code_block_2 = CodeBlock { 0..100..10; 25; }
byCoordinates_2 = Point.ByCoordinates(x=code_block_2.out0, y=code_block_2.out1)
byStartPointEndPoint = Line.ByStartPointEndPoint(startPoint=byCoordinates, endPoint=byCoordinates_2)
watch = Watch(byStartPointEndPoint)

# group: List Lacing - Longest
code_block_3 = CodeBlock { 0..60..10; 40; }
byCoordinates_3 = Point.ByCoordinates(x=code_block_3.out0, y=code_block_3.out1)
code_block_4 = CodeBlock { 0..100..10; 65; }
byCoordinates_4 = Point.ByCoordinates(x=code_block_4.out0, y=code_block_4.out1)
byStartPointEndPoint_2 = Line.ByStartPointEndPoint(startPoint=byCoordinates_3, endPoint=byCoordinates_4, lacing=Longest)
watch_2 = Watch(byStartPointEndPoint_2)

# group: List Lacing - Cross Product
code_block_5 = CodeBlock { 0..60..10; 80; }
byCoordinates_5 = Point.ByCoordinates(x=code_block_5.out0, y=code_block_5.out1)
code_block_6 = CodeBlock { 0..100..10; 105; }
byCoordinates_6 = Point.ByCoordinates(x=code_block_6.out0, y=code_block_6.out1)
byStartPointEndPoint_3 = Line.ByStartPointEndPoint(startPoint=byCoordinates_5, endPoint=byCoordinates_6, lacing=CrossProduct)
watch_3 = Watch(byStartPointEndPoint_3)
