# Dynamo graph 10_03_ListManagement.dyn (Dynamo 1.3.2.2480)

# group: Basic Operations
string = StringInput("Berlin")
string_2 = StringInput("Paris")
string_3 = StringInput("Barcelona")
create = List.Create(string, string_2, string_3)
string_4 = StringInput("Rome")
string_5 = StringInput("Zagreb")
string_6 = StringInput("Istanbul")
create_2 = List.Create(string_4, string_5, string_6)
create_3 = List.Create(create, create_2)
watch = Watch(create_3)
code_block = CodeBlock { 0; }
getItemAtIndex = List.GetItemAtIndex(list=watch, index=code_block)
watch_2 = Watch(getItemAtIndex)
transpose = List.Transpose(watch)
watch_3 = Watch(transpose)
count = List.Count(watch)
watch_4 = Watch(count)

flatten = Flatten(watch)

# group (continued): Basic Operations
watch_5 = Watch(flatten)

# group: List Structure
string_7 = StringInput("Piece of Data")
create_4 = List.Create(string_7)
# note: A List with a Single Element
watch_6 = Watch(create_4)
# note: Single Element
watch_7 = Watch(string_7)
string_8 = StringInput("London")
string_9 = StringInput("New York")
string_10 = StringInput("Wellington")
string_11 = StringInput("Singapore")
create_5 = List.Create(string_8, string_9, string_10, string_11)
# note: A List with a Multiple Elements
watch_8 = Watch(create_5)
string_12 = StringInput("Berlin")
string_13 = StringInput("Paris")
string_14 = StringInput("Barcelona")
create_6 = List.Create(string_12, string_13, string_14)
string_15 = StringInput("Rome")
string_16 = StringInput("Zagreb")
string_17 = StringInput("Istanbul")
create_7 = List.Create(string_15, string_16, string_17)
create_8 = List.Create(create_6, create_7)
# note: Multiple Lists with Multiple Elements
watch_9 = Watch(create_8)

# group: List @ Levels
string_18 = StringInput("Berlin")
string_19 = StringInput("Paris")
string_20 = StringInput("Barcelona")
create_9 = List.Create(string_18, string_19, string_20)
string_21 = StringInput("Rome")
string_22 = StringInput("Zagreb")
string_23 = StringInput("Istanbul")
create_10 = List.Create(string_21, string_22, string_23)
create_11 = List.Create(create_9, create_10)
watch_10 = Watch(create_11)
count_2 = List.Count(watch_10@L2)
watch_11 = Watch(count_2)
code_block_2 = CodeBlock { 1; }
getItemAtIndex_2 = List.GetItemAtIndex(list=watch_10@L2, index=code_block_2)
watch_12 = Watch(getItemAtIndex_2)
