# Dynamo graph 10_04_Intro to Vectors.dyn (Dynamo 1.3.0.875)

# group: 1) TRADITIONAL APPROACH (visible): Creating a line by two points
origin = Point.Origin()
integer_slider = IntegerSlider(5, range=0..10 step 1)
integer_slider_2 = IntegerSlider(5, range=0..10 step 1)
byCoordinates = Point.ByCoordinates(x=integer_slider, y=integer_slider_2)
byStartPointEndPoint = Line.ByStartPointEndPoint(startPoint=origin, endPoint=byCoordinates)
byTwoPoints = Vector.ByTwoPoints(start=origin, end=byCoordinates)

# group: 2a) VECTOR APPROACH (invisible): Creating a second point using a vector
origin_2 = Point.Origin()
integer_slider_3 = IntegerSlider(5, range=0..10 step 1)
integer_slider_4 = IntegerSlider(5, range=0..10 step 1)
byCoordinates_2 = Vector.ByCoordinates(x=integer_slider_3, y=integer_slider_4)
add = Point.Add(point=origin_2, vectorToAdd=byCoordinates_2)

# group: 2b) VECTOR APPROACH (invisible): Visualizing the line
origin_3 = Point.Origin()
integer_slider_5 = IntegerSlider(5, range=0..10 step 1)
integer_slider_6 = IntegerSlider(5, range=0..10 step 1)
byCoordinates_3 = Vector.ByCoordinates(x=integer_slider_5, y=integer_slider_6)
add_2 = Point.Add(point=origin_3, vectorToAdd=byCoordinates_3)
length = Vector.Length(byCoordinates_3)
byStartPointDirectionLength = Line.ByStartPointDirectionLength(startPoint=origin_3, direction=byCoordinates_3, length=length)

# group: 3) WHY USE VECTORS? - Computational Cost Visualizing geometry requires much more computer processing than the mathematical calculation of vectors. To better understand this, first un-freeze the Vector.ByTwoPoints & see how long it takes to complete the task. Then un-freeze the Line.ByStartPointEndPoint & see that it takes MUCH longer to complete the task. Think about how much slower a lines/points approach would be at-scale on a large Dynamo project vs. using as many vectors as possible.
code_block = CodeBlock { 0..20; }
byCoordinates_4 = Point.ByCoordinates(x=code_block, y=code_block, lacing=CrossProduct)
# note: Step 1 - turn preview ON to see points
flatten = Flatten(byCoordinates_4)
# note: Step 3 - un-freeze & asses time to complete
byStartPointEndPoint_2 = Line.ByStartPointEndPoint(startPoint=flatten, endPoint=flatten, lacing=CrossProduct)  # frozen
count = Count(byStartPointEndPoint_2)
# note: Step 2 - un-freeze & asses time to complete
byTwoPoints_2 = Vector.ByTwoPoints(start=flatten, end=flatten, lacing=CrossProduct)  # frozen
count_2 = Count(byTwoPoints_2)
