# Dynamo graph 10_3D Canvas Points.dyn "AU2018_Dynamo example_custom points" (Dynamo 2.0.1.5055)

number_slider = DoubleSlider(-10.846, range=-10.846..100 step 0.1)
number_slider_2 = DoubleSlider(8.764, range=0..100 step 0.1)
byCoordinates = Point.ByCoordinates(x=number_slider, y=number_slider_2)
number_slider_3 = DoubleSlider(9.037, range=0..100 step 0.1)
number_slider_4 = DoubleSlider(15.316, range=0..100 step 0.1)
number_slider_5 = DoubleSlider(8.817, range=0..100 step 0.1)
byCoordinates_2 = Point.ByCoordinates(x=number_slider_3, y=number_slider_4, z=number_slider_5)
number_slider_6 = DoubleSlider(11.923, range=0..100 step 0.1)
number_slider_7 = DoubleSlider(-8.307, range=-8.307..100 step 0.1)
number_slider_8 = DoubleSlider(-2.876, range=-2.876..100 step 0.1)
byCoordinates_3 = Point.ByCoordinates(x=number_slider_6, y=number_slider_7, z=number_slider_8)
number_slider_9 = DoubleSlider(-4.833, range=-4.833..100 step 0.1)
number_slider_10 = DoubleSlider(-5.631, range=-8.343..100 step 0.1)
number_slider_11 = DoubleSlider(4.242, range=0..100 step 0.1)
byCoordinates_4 = Point.ByCoordinates(x=number_slider_9, y=number_slider_10, z=number_slider_11)
number_slider_12 = DoubleSlider(-15.376, range=-15.376..100 step 0.1)
number_slider_13 = DoubleSlider(-11.117, range=-11.117..100 step 0.1)
number_slider_14 = DoubleSlider(3.706, range=0..100 step 0.1)
byCoordinates_5 = Point.ByCoordinates(x=number_slider_12, y=number_slider_13, z=number_slider_14)
join = List.Join(list0=byCoordinates, list1=byCoordinates_2, list2=byCoordinates_3, list3=byCoordinates_4, list4=byCoordinates_5)
boolean = BoolSelector(true)
byPoints = PolyCurve.ByPoints(points=join, connectLastToFirst=boolean)
