# Dynamo graph 10_Bonus - Numbering.dyn (Dynamo 2.0.1.5055)

# group: 1. Select and Trace Curtain Panels at Edges
# note: Select all Curtain Panels of a paraticular type. This will select all of the panels on the edges.
family_types = FamilyTypes(index=163)  # graph input
all_elements_of_family_type = ElementsOfFamilyType(Family_Type=family_types)
watch = Watch(all_elements_of_family_type)
boundaries = CurtainPanel.Boundaries(curtainPanel=all_elements_of_family_type)
# note: Trace the outline of the panels. This creates a nested list, flatten it to make it easier to process, then count the number of curves (edges) in each polycurve.
flatten = List.Flatten(list=boundaries)
numberOfCurves = PolyCurve.NumberOfCurves(polyCurve=flatten)
# note: This test checks to see if there are four curves. This results in true or false values.
number = DoubleInput(4)  # graph input
eq = numberOfCurves == number

# group: 2. Create Mark values
# note: Write the values back to Revit.
string = StringInput("Mark")  # graph input
# note: Count the number of panels above and use that to create a sequence of numbers. These need to be converted to text, since the "Mark" field in Revit is a text field.
count = List.Count(list=all_elements_of_family_type)
sequence = Sequence(amount=count, lacing=Longest)
string_from_object = FromObject(obj=sequence)
# note: Pad the numbers with zeros to make the length of all Mark values the same.
lastItem = List.LastItem(list=string_from_object)
length = String.Length(str=lastItem)
string_2 = StringInput("0")  # graph input
padLeft = String.PadLeft(str=string_from_object, newWidth=length, padChars=string_2)
# note: An "If" test assigns a different suffix to each value based on number of curves above.
string_3 = StringInput("_Quad")  # graph input
string_4 = StringInput("_Mult")  # graph input
if_ = If(test=eq, true=string_3, false=string_4)
add = padLeft + if_
setParameterByName = Element.SetParameterByName(element=all_elements_of_family_type, parameterName=string, value=add)
