# Dynamo graph 10_Random Windows.dyn (Dynamo 1.3.2.2480)

categories = Categories("Windows")
all_elements_of_category = ElementsOfCategory(categories)
# note: Clockwork
all_family_types_of_category = Custom[All Family Types Of Category](category=categories)  # Gets all family types/symbols of a given category in the model (does *not *work for system families)
number = DoubleInput(1)
number_2 = DoubleInput(7)
count = List.Count(all_elements_of_category)
integer_slider = IntegerSlider(49, range=0..100 step 1)
randomNumbers = Lists.Sequence.RandomNumbers(number, number_2, count, integer_slider)
round = Math.Round(randomNumbers)
getItemAtIndex = List.GetItemAtIndex(list=all_family_types_of_category, index=round)
setType = Custom[FamilyInstance.SetType](familyInstance=all_elements_of_category, familyType=getItemAtIndex)  # Changes the family type of a given family instance to the specified type
