# Dynamo graph 10_Rename Views.dyn (Dynamo 1.3.2.2480)

categories = Categories("Views")
all_elements_of_category = ElementsOfCategory(categories)
string = StringInput("View Name")
getParameterValueByName = Element.GetParameterValueByName(element=all_elements_of_category, parameterName=string)
toUpper = String.ToUpper(getParameterValueByName)
setParameterByName = Element.SetParameterByName(element=all_elements_of_category, parameterName=string, value=toUpper)
parameters = Element.Parameters(all_elements_of_category)
