# Dynamo graph 10_RoomOccupancies_Color.dyn (Dynamo 2.0.1.5055)

# group: Room Occupancies
# note: Graph Courtesy of:
# Sol Amour     twitter: @solamour
# Mark Thorley     twitter: @MarkThorley1

# group: 1. Select Rooms
# note: Categories node. This refers to all categories inside of Revit (Such as Doors, Walls, Columns, Ducts etc)
categories = Categories(index=425)  # graph input
# note: This node collects all elements (Inside a Revit project) of the chosen Category.
all_elements_of_category = ElementsOfCategory(Category=categories)
watch = Watch(all_elements_of_category)

# group: 1A. List all Parameters
# note: This node will take an Element and query every single parameter it has and give a list that showcases the data in the following way: 'ParameterName : ParameterValue'
# This can be a good way to see what parameters are available when building a graph
parameters = Element.Parameters(element=all_elements_of_category)
watch_2 = Watch(parameters)

# group: 2. Filter Rooms by Name
# note: The String here has the name of the parameter we want to extract
string = StringInput("Name")
getParameterValueByName = Element.GetParameterValueByName(element=all_elements_of_category, parameterName=string)
watch_3 = Watch(getParameterValueByName)
# note: This String has the name of the rooms we are looking for.
# note: We use an equality comparison here to see if our Room Names match our chosen room (Instruction). This will result in either a True or a False.
string_2 = StringInput("Instruction")
eq = getParameterValueByName == string_2
# note: The list comes from our original selction of rooms in the model. The True and False values split the list into two list. The ones whose values are true will go to the "in" port, False values will go to the "out" port.
filterByBoolMask = List.FilterByBoolMask(list=all_elements_of_category, mask=eq)
watch_4 = Watch(filterByBoolMask.in)
# note: Watch nodes is a nice way to see the output of each port separately.
watch_5 = Watch(filterByBoolMask.out)

string_3 = StringInput("Occupancy")
number = DoubleInput(1.86)

# group: 3. Calculate occupancy value
string_4 = StringInput("Area")
# note: From our filtered list ("in" values only) query the Area of each Room.
getParameterValueByName_2 = Element.GetParameterValueByName(element=filterByBoolMask.in, parameterName=string_4)
# note: We use a Division node here to divide our Room Areas by a chosen value. Check your local building code.
div = getParameterValueByName_2 / number
# note: This node is a mathematical operation that rounds down (floors) the value.
floor = Math.Floor(number=div)

# group: 4. Set Parameter in Model
# note: The value input for 'Occupancy' requries text only - so we run into error if we try to feed the calculated numbers directly. This node converts the numbers to text.
string_from_object = FromObject(obj=floor)
# note: This node writes the values back to the Revit model.
setParameterByName = Element.SetParameterByName(element=filterByBoolMask.in, parameterName=string_3, value=string_from_object)  # frozen

# group: Check selected Rooms by applying color to the selection
# note: We use a Boolean toggle node here to choose if we wish to render the Geometry of our Rooms in the background of Dynamo (It will take a little while)
boolean_show_geometry = BoolSelector(false)  # graph input
code_block = CodeBlock { null; }
# note: These IF nodes are used to select a different list based on if the Boolean | Show Geometry node is set to True/False.
# There are two separate IF nodes, one for the Compliant Rooms and the other for Non-compliant Rooms.
# If the Boolean | Show Geometry node is set to False, a 'null' (Nothing) is passed through that causes the downstream graph to fail (Which we want in this case).
if_compliant = If(test=boolean_show_geometry, true=filterByBoolMask.in, false=code_block)
# note: This node will create Dynamo geometry from the Revit Element (Rooms) inside Dynamo - but only if the True boolean value is chosen. It will fail otherwise.
# Notice the gray color of the node? This indicates that the preview of this node is disabled to avoid in-canvas clutter.
geometry = Element.Geometry(element=if_compliant)
number_2 = DoubleInput(150)
number_3 = DoubleInput(128)
number_4 = DoubleInput(255)
# note: Here we are using Color.ByARGB nodes to stipulate Dynamo colours - one for Compliant & the other for Non-compliant. (Alpha (transparency), red, green, blue) [0-255]
byARGB = Color.ByARGB(a=number_2, r=number_3, g=number_4, b=number_3)
# note: These nodes will display the Geometry by a colour inside of Dynamo.
byGeometryColor = Modifiers.GeometryColor.ByGeometryColor(geometry=geometry, color=byARGB)
if_non_compliant = If(test=boolean_show_geometry, true=filterByBoolMask.out, false=code_block)
geometry_2 = Element.Geometry(element=if_non_compliant)
number_5 = DoubleInput(50)
byARGB_2 = Color.ByARGB(a=number_5, r=number_4, g=number_4, b=number_4)
byGeometryColor_2 = Modifiers.GeometryColor.ByGeometryColor(geometry=geometry_2, color=byARGB_2)
