# Dynamo graph 10_SetRotation.dyn "03_Freeform_01_SetRotation_KM update" (Dynamo 2.0.1.5055)

# group: Original Graph
family_types = FamilyTypes(index=16)  # graph input
select_model_element = DSModelElementSelection()  # 1 picked in the model; graph input
curves = Element.Curves(element=select_model_element)
number = DoubleInput(1)  # graph input
number_slider = DoubleSlider(0.2, range=0..0.2 step 0.01)  # graph input
range = Range(end=number, step=number_slider, lacing=Longest)
pointAtParameter = Curve.PointAtParameter(curve=curves, param=range, lacing=CrossProduct)

# group: NEW PORTION ADDED BY KYLE
flatten = List.Flatten(list=pointAtParameter)
code_block = CodeBlock { -90; }
count = List.Count(list=flatten)
code_block_2 = CodeBlock(count=count) { count-1; }
code_block_3 = CodeBlock(amount=code_block_2) { amount; -amount; }
takeItems = List.TakeItems(list=flatten, amount=code_block_3.amount)
takeItems_2 = List.TakeItems(list=flatten, amount=code_block_3.out1)
byTwoPoints = Vector.ByTwoPoints(start=takeItems, end=takeItems_2)
startPoint = Curve.StartPoint(curve=curves)
endPoint = Curve.EndPoint(curve=curves)
byTwoPoints_2 = Vector.ByTwoPoints(start=startPoint, end=endPoint)
ZAxis = Vector.ZAxis()
angleAboutAxis = Vector.AngleAboutAxis(vector=byTwoPoints, otherVector=byTwoPoints_2, rotationAxis=ZAxis, lacing=Longest)
code_block_4 = CodeBlock { 180; }
gt = angleAboutAxis > code_block_4
code_block_5 = CodeBlock(angle=angleAboutAxis) { angle-360; }
if_ = If(test=gt, true=code_block_5, false=angleAboutAxis)
code_block_6 = CodeBlock { 90; }
sub = if_ - code_block_6
addItemToEnd = List.AddItemToEnd(item=code_block, list=sub)
# note: for visual understanding only
byStartPointEndPoint = Line.ByStartPointEndPoint(startPoint=startPoint, endPoint=endPoint)
byStartPointEndPoint_2 = Line.ByStartPointEndPoint(startPoint=takeItems, endPoint=takeItems_2)

# group (continued): Original Graph
byPoint = FamilyInstance.ByPoint(familyType=family_types, point=flatten)

setRotation = FamilyInstance.SetRotation(familyInstance=byPoint, degree=addItemToEnd)
