# Dynamo graph Core_AttractorPoint.dyn (Dynamo 2.0.1.5055)

# group: XXX Attractor Point Example
# note: ATTRACTOR POINT
# Scripting 101.
# An attractor point is a quick way to make variation across a field of objects.  It works by creating a grid of objects that have some parameter determined by the distance between the object and a point that moves around.
# To visualize what's going on, move the two sliders that control the location of the attractor point.

# group: Create point sequence
# note: Range syntax: 1 to 50, skipping by 5's
code_block = CodeBlock { 1..50..5; }
# note: Grid of points.
# To make, pass a series of numbers into at least two ports.  Change the lacing behavior of the node to "Cross product"
byCoordinates = Point.ByCoordinates(x=code_block, y=code_block, lacing=CrossProduct)
# note: Flatten the list because the hierarchy of rows and columns is not needed.  Compare the input to this node with the output.
flatten = List.Flatten(list=byCoordinates)

# group: XXX Inputs
number_slider = DoubleSlider(28.6701556, range=-10..60 step 0.1)  # graph input
number_slider_2 = DoubleSlider(11.50111001, range=-10..60 step 0.1)  # graph input

# group: Create attractor point
# note: Attractor Point.  Move the input sliders to adjust the location of this point.
byCoordinates_2 = Point.ByCoordinates(x=number_slider, y=number_slider_2)

# group: Compute cylinder height & radius
code_block_2 = CodeBlock { 0; }
# note: Finds the distance between the attractor point and the base point of the cylinders
distanceTo = Geometry.DistanceTo(geometry=flatten, other=byCoordinates_2, lacing=Longest)
# note: Formula to make the height of the cylinders react to the location of the attractor point.  Can be different from the formula controlling the radii.
code_block_3 = CodeBlock(x=distanceTo) { x/2; }
byCoordinates_3 = Vector.ByCoordinates(x=code_block_2, y=code_block_2, z=code_block_3)
# note: Formula adjusts the amount of variation between the radii of the cylinders.  Try using a different formula.
# note: Add this new z-value (height) to the original grid points to get the top points for the cylinders.
add = Point.Add(point=flatten, vectorToAdd=byCoordinates_3)
code_block_4 = CodeBlock(x=distanceTo) { x/15; }

# group: Create cylinders
byPointsRadius = Cylinder.ByPointsRadius(startPoint=flatten, endPoint=add, radius=code_block_4)
