# Dynamo graph Core_Strings.dyn (Dynamo 2.0.1.5055)

# group: XXX String Example
# note: STRINGS
# This set of examples shows some of the available functionality for dealing with strings.  More can be found in the Core/String library.

# group: XXX Inputs
# note: Specify a string in a Code Block with "" marks or in a string node.
string = StringInput("\"Few things are harder to put up with than a good example.\"")
string_2 = StringInput(" - Mark Twain")

# group: Some string operations
# note: Change the case of a string
toUpper = String.ToUpper(str=string_2)
watch = Watch(toUpper)
# note: Attaching two strings together to make one is called "concatenating," or "concat" for short.
concat = String.Concat(string0=string, string1=watch)
watch_2 = Watch(concat)

# group: More string operations
code_block = CodeBlock { "put"; }
code_block_2 = CodeBlock { "come"; }
# note: Replace instances of a string inside a larger string.
replace = String.Replace(str=watch_2, searchFor=code_block, replaceWith=code_block_2)
watch_3 = Watch(replace)

# group: Even more string operations
# note: Find the total number of characters in a string.
code_block_3 = CodeBlock { " to"; }
# note: Find where a particular string occurse in a larger string.
indexOf = String.IndexOf(str=watch_3, searchFor=code_block_3)
watch_4 = Watch(indexOf)
length = String.Length(str=watch_3)
watch_5 = Watch(length)
sub = watch_5 - watch_4
# note: Remove a certain number of characters from a string.
remove = String.Remove(str=watch_3, startIndex=watch_4, count=sub)
watch_6 = Watch(remove)

# group: Counting stuff
code_block_4 = CodeBlock { "ar"; }
# note: Count the occurances of a string inside a longer string.
countOccurrences = String.CountOccurrences(str=watch_6, searchFor=code_block_4)
watch_7 = Watch(countOccurrences)
