# Dynamo graph Geometry_Curves.dyn (Dynamo 2.0.1.5055)

# group: XXX Inputs
number = DoubleInput(5)
number_2 = DoubleInput(10)
number_3 = DoubleInput(15)

# group: Create Points
byCoordinates = Point.ByCoordinates()
byCoordinates_2 = Point.ByCoordinates(y=number)
byCoordinates_3 = Point.ByCoordinates(x=number_2, y=number_2)
byCoordinates_4 = Point.ByCoordinates(x=number_3)
create = List.Create(item0=byCoordinates, item1=byCoordinates_2, item2=byCoordinates_3, item3=byCoordinates_4)

# group: Create Curves
byPoints = NurbsCurve.ByPoints(points=create)
# note: Multiple creation methods exist for most curves.
byStartPointEndPoint = Line.ByStartPointEndPoint(startPoint=byCoordinates, endPoint=byCoordinates_2)
length = Curve.Length(curve=byStartPointEndPoint)
boolean = BoolSelector(true)
byControlPoints = NurbsCurve.ByControlPoints(points=create, closeCurve=boolean)
byPoints_2 = PolyCurve.ByPoints(points=create)

# group: Create Curve Segments
code_block = CodeBlock { 0..1..#20; }
# note: Curves, Polycurves (collections of Curves), Nurbs, and Lines all derive from "Curves", and so all Curve "Actions" and "Queries" can be done to all of them
pointAtParameter = Curve.PointAtParameter(curve=byPoints_2, param=code_block)
