# Dynamo graph Exercise 4.dyn (Dynamo 2.2.1.5175)

file_path = Filename("..\Exercise 4.py")
file_from_path = FileObject(path=file_path)
readText = FileSystem.ReadText(file=file_from_path)
select_model_element = DSModelElementSelection()  # 1 picked in the model
getLocation = Element.GetLocation(element=select_model_element)
select_model_element_2 = DSModelElementSelection()  # 1 picked in the model
getLocation_2 = Element.GetLocation(element=select_model_element_2)
ZAxis = Vector.ZAxis()
levels = Levels("02 - Floor")
elevation = Level.Elevation(level=levels)
translate = Geometry.Translate(geometry=getLocation_2, direction=ZAxis, distance=elevation)
number_slider = DoubleSlider(9, range=0..10 step 1)
wall_types = WallTypes("Interior - Blockwork 100")
python_script_from_string = PythonStringNode(script=readText, IN[0]=getLocation, IN[1]=translate, IN[2]=number_slider, IN[3]=wall_types, IN[4]=levels)
