# Dynamo graph Exercise 1.dyn (Dynamo 2.2.1.5175)

file_path = Filename("No file selected.")
file_from_path = FileObject(path=file_path)
readText = FileSystem.ReadText(file=file_from_path)
select_model_elements = DSModelElementsSelection()  # nothing selected
python_script_from_string = PythonStringNode(script=readText, IN[0]=select_model_elements)
