# Dynamo graph Desk workflow.dyn (Dynamo 2.4.1.6394)

code_block = CodeBlock { 10; }
byWidthLength = Rectangle.ByWidthLength(width=code_block, length=code_block)
byPatch = Surface.ByPatch(closedCurve=byWidthLength)
layoutDesksOnSurface = DynamoDev.Layout.DeskArchitect.LayoutDesksOnSurface(surface=byPatch)
createdAt = DynamoDev.Layout.DeskArrangement.CreatedAt(deskArrangement=layoutDesksOnSurface)
deskCount = DynamoDev.Layout.DeskArrangement.DeskCount(deskArrangement=layoutDesksOnSurface)
desks = DynamoDev.Layout.DeskArrangement.Desks(deskArrangement=layoutDesksOnSurface)
origin = DynamoDev.Business.Desk.Origin(desk=desks)
