# Dynamo graph TestGraph.dyn (Dynamo 2.4.0.6186)

code_block = CodeBlock { 53; }
number = DoubleInput(0)
number_slider = DoubleSlider(1, range=0..100 step 0.1)
code_block_2 = CodeBlock(x=code_block, y=number, z=number_slider) { x+y+z; }
watch = Watch(code_block_2)
