# Dynamo graph AU2019_BIM-Managers_DynamoAnalyticsPythonNode.dyn (Dynamo 2.2.1.5175)

# group: FUNCTION
# note: Data manipulation on dynamo objects

# group: OUTPUT
# note: Object creation in Host | Final output

# group: SET
# note: Set parameter values of Host objects

# group: INPUT
# note: Data input and preparation

# group: GET
# note: Get parameter values from Host objects

# group: In-Graph Tracker
# note: This version of the Python based 'Dynamo Graph Analytics' node is in canvas.
# Pros:
# 1. Ships with every graph it's embedded into.
# 2. Pushes out analytics to the desktop of the user (or any chosen file path)
# 3. Instant feedback when making amendments to the Python node
# Cons:
# 1. Hard to maintain as you'll have to update every graph
# 2. Can become misaligned with other graphs containing this node
# 3. Updates will not roll out to every graph containing this node automatically. Bespoke updates have to be made
python_script_ingraph = Python()  # frozen
# ---------- python_script_ingraph.python (177 lines) ----------
"""
Dynamo graph check and usage tracking.
"""

__author__ = 'Dynamo BIM Managers: AU 2019'
__version__ = '1.0'


import clr
import sys
sys.path.append(r'C:\Program Files (x86)\IronPython 2.7\Lib')
import System
from System import Environment
from System.IO import *
import os
import csv

"""
# Old way (Revit 2019 and down) to access the Dynamo DLLs
dynamoAPIFolder = Directory.CreateDirectory(r'C:\Program Files\Dynamo\Dynamo Core')
latest = sorted([s.Name for s in dynamoAPIFolder.GetDirectories()])[-1]
clr.AddReferenceToFileAndPath(Path.Combine(dynamoAPIFolder.FullName, latest, 'DynamoCore.dll'))
clr.AddReferenceToFileAndPath(Path.Combine(dynamoAPIFolder.FullName, latest, 'DynamoCoreWpf.dll'))
"""

# New way to access Dynamo DLLs as Revit now incorporates Dynamo as a feature
sys.path.append(r'C:\Program Files\Autodesk\Revit 2020\AddIns\DynamoForRevit')
sys.path.append(r'C:\Program Files\Autodesk\Revit 2020\AddIns\DynamoForRevit\Revit')
	
clr.AddReference('DynamoCore.dll')
clr.AddReference('DynamoCoreWpf.dll')
clr.AddReference('DynamoRevitDS.dll')

from Dynamo.ViewModels import *
from Dynamo.Models import *
from Dynamo.Graph.Workspaces import *

try:
	
	clr.AddReference("RevitServices")
	import RevitServices
	from RevitServices.Persistence import DocumentManager
	
	doc = DocumentManager.Instance.CurrentDBDocument
	uiapp = DocumentManager.Instance.CurrentUIApplication
	revitApp = uiapp.Application
	
	clr.AddReference("RevitAPI")
	import Autodesk
	from Autodesk.Revit.DB import *
	
	if doc.IsWorkshared:
	    revitDoc = ModelPathUtils.ConvertModelPathToUserVisiblePath(doc.GetWorksharingCentralModelPath())
	else:
	    revitDoc = DocumentManager.Instance.CurrentDBDocument.PathName
	
	if len(revitDoc) == 0:
	    revitDoc = 'None'
	
	version = doc.Application.VersionNumber
	
	from Dynamo.Applications import *
	app = DynamoRevit()
	model = app.RevitDynamoModel
	ws = model.CurrentWorkspace
	dynpath = ws.FileName # Gets the Dynamo File Path
	dynname = Path.GetFileName(dynpath) # Gets the Dynamo File Name
	
	nodeCount = len(ws.Nodes)  # Counts the total amount of Nodes in the Workspace
	wireCount = len(list(ws.Connectors))  # Counts the total amount of Wires in the Workspace
	lastSave = ws.LastSaved  # Get's the time and date of last Graph Save
	notes = list(ws.Notes)  # Captures the Workspace Note objects and casts to a list
	
	notesList,catchList = [],[]
	for line in notes:
		catchList.append(line.Text) # Get's the Text content of each Note

	keys = ["OFFICE: ", "AUTHOR NAME: ", "AUTHOR EMAIL: ", "TESTED ON: ", "RATING: ", "KEYWORDS: "] # Template data to export

	for k in keys:  # Captures only the relevant Note Data based around a colon split
		for n in catchList:
			if k in n:
				notesList.append(n.split(':')[-1])
			else:
				pass
				
	dataOffice = notesList[0]
	dataAuthorName = notesList[1]
	dataAuthorEmail = notesList[2]
	dataTestedOn = notesList[3]
	dataRating = notesList[4]
	dataKeywords = notesList[5]
	
	appName = revitApp.VersionName # Gets the Revit Version 
	appNumber = revitApp.VersionNumber # Gets the Revit Version Number
	appBuild = revitApp.VersionBuild # Gets the Revit Version Build
	appLanguage = str(revitApp.Language) # Gets the Revit Language
	
	# Getting Physical Memory (RAM) of Machine
	process = os.popen('wmic memorychip get capacity')
	result = process.read()
	process.close()
	totalMem = 0
	
	for m in result.split(" \r\n")[1:-1]:
	    totalMem += int(m)
	
	machineRam = totalMem / (1024**3) # Gets the Machines Ram
	
	# Machine data
	userName = Environment.UserName # Gets the Username
	machineName = Environment.MachineName # Gets the Machines Name
	machineOS = Environment.OSVersion # Gets the OS Version
	machineProcessor = Environment.ProcessorCount # Gets the Machines Processor Count
	machineVersion = Environment.Version # Gets the Machines Version
	
	summary = {
				"Machine" :
					{
					"Username" : userName,
					"Name" : machineName,
					"OS" : machineOS,
					"Processor Count" : machineProcessor,
					"Version" : machineVersion,
					"RAM" : machineRam
					},
				"Dynamo" :
					{
					"Path" : dynpath,
					"Name" : dynname,
					"Node Count" : nodeCount,
					"Wire Count" : wireCount,
					"Last Saved" : lastSave
					},
				"Revit" :
					{
					"Version Name" : appName,
					"Version Number" : appNumber,
					"Version Build" : appBuild,
					"Language" : appLanguage,
					"Revit Document" : revitDoc
					}
				}


except Exception as ex:
    summary = ex.message

###############################################################################################################################
########### 			CHANGE THE FILE PATH AND FILE NAME TO THE SHARED LOCATION 				###############################
###############################################################################################################################
tracker = Path.Combine(Environment.GetFolderPath(Environment.SpecialFolder.Desktop), 'DynamoTracker_' + userName + '.csv')

trace = [userName, machineName, machineOS, machineProcessor, machineRam,
         machineVersion, appName, appNumber, appBuild, appLanguage, revitDoc, 
         dynname, dynpath, lastSave, nodeCount, wireCount, dataOffice, 
         dataAuthorName, dataAuthorEmail, dataTestedOn, dataRating, dataKeywords]

headers = ['User: Username', 'Machine: Name', 'Machine: Operating System', 'Machine: Processor', 
			'Machine: RAM', 'Machine: Version','Application: Name', 'Application: Version', 
			'Application: Build Number', 'Application: Language', 'Application: Document Path', 
			'Graph: Name', 'Graph: Path', 'Graph: Last Saved', 'Graph: Node Count', 
			'Graph: Wire Count', 'Info: Office', 'Info: Author Name', 'Info: Author Email', 
			'Info: Tested On', 'Info: Rating', 'Info: Keywords']

if os.path.isfile(tracker):
    with open(tracker, 'ab') as f:
        writer = csv.writer(f, dialect='excel')
        writer.writerow(trace)
else:
    with open(tracker, 'ab') as f:
        writer = csv.writer(f, dialect='excel')
        writer.writerow(headers)
        writer.writerow(trace)
trace = []

OUT = summary
# ----------------------------------------

# group: External Python Tracker
# note: This version of the Python based 'Dynamo Graph Analytics' node is in canvas.
# Pros:
# 1. Ships with every graph it's embedded into.
# 2. Pushes out analytics to a single centralized location of the BIM Managers choosing.
# 3. Will update every single graph automatically when the single Python file is updated.
# Cons:
# 1. No instant feedback when making amendments.
# 2. Requires ability to write Python external to Dynamo (i.e in Atom / Sublime)
python_script_external = Python()  # frozen
# ---------- python_script_external.python (8 lines) ----------
import sys
sys.path.append(r'Y:\OneDrive - autodesk\01 AEC Generative\Dynamo\AU 2019')

# Importing our external Python module
import dynamoAnalytics

# Sending out a Summary to the Dynamo Document
OUT = dynamoAnalytics.summary
# ----------------------------------------

# group: LANDING PAGE
# note: This Python Script creates a CSV file to track the usage of the Dynamo file.
# note: OFFICE: <Office>
# note: AUTHOR NAME: <Author Name>
# note: AUTHOR EMAIL: <Author Email>
# note: TESTED ON: <Tested On>
# note: RATING: <Rating - i.e 1-5>
# note: KEYWORDS: <Keyword 1, Keyword 2, Keywords N>
dynamo_analytics = Python()
# ---------- dynamo_analytics.python (186 lines) ----------
"""
Dynamo graph check and usage tracking.
"""

__author__ = 'Dynamo BIM Managers: AU 2019'
__version__ = '1.0'


import clr
import sys
sys.path.append(r'C:\Program Files (x86)\IronPython 2.7\Lib')
import System
from System import Environment
from System.IO import *
import os
import csv

"""
# Old way (Revit 2019 and down) to access the Dynamo DLLs
dynamoAPIFolder = Directory.CreateDirectory(r'C:\Program Files\Dynamo\Dynamo Core')
latest = sorted([s.Name for s in dynamoAPIFolder.GetDirectories()])[-1]
clr.AddReferenceToFileAndPath(Path.Combine(dynamoAPIFolder.FullName, latest, 'DynamoCore.dll'))
clr.AddReferenceToFileAndPath(Path.Combine(dynamoAPIFolder.FullName, latest, 'DynamoCoreWpf.dll'))
"""

# New way to access Dynamo DLLs as Revit now incorporates Dynamo as a feature
sys.path.append(r'C:\Program Files\Autodesk\Revit 2020\AddIns\DynamoForRevit')
sys.path.append(r'C:\Program Files\Autodesk\Revit 2020\AddIns\DynamoForRevit\Revit')
    
clr.AddReference('DynamoCore.dll')
clr.AddReference('DynamoCoreWpf.dll')
clr.AddReference('DynamoRevitDS.dll')

from Dynamo.ViewModels import *
from Dynamo.Models import *
from Dynamo.Graph.Workspaces import *

try:
    
    clr.AddReference("RevitServices")
    import RevitServices
    from RevitServices.Persistence import DocumentManager
    
    doc = DocumentManager.Instance.CurrentDBDocument
    uiapp = DocumentManager.Instance.CurrentUIApplication
    revitApp = uiapp.Application
    
    clr.AddReference("RevitAPI")
    import Autodesk
    from Autodesk.Revit.DB import *
    
    if doc.IsWorkshared:
        revitDoc = ModelPathUtils.ConvertModelPathToUserVisiblePath(doc.GetWorksharingCentralModelPath())
    else:
        revitDoc = DocumentManager.Instance.CurrentDBDocument.PathName
    
    if len(revitDoc) == 0:
        revitDoc = 'None'
    
    version = doc.Application.VersionNumber
    
    from Dynamo.Applications import *
    app = DynamoRevit()
    model = app.RevitDynamoModel
    ws = model.CurrentWorkspace
    dynpath = ws.FileName # Gets the Dynamo File Path
    dynname = Path.GetFileName(dynpath) # Gets the Dynamo File Name
    
    nodeCount = len(ws.Nodes)  # Counts the total amount of Nodes in the Workspace
    wireCount = len(list(ws.Connectors))  # Counts the total amount of Wires in the Workspace
    lastSave = ws.LastSaved  # Get's the time and date of last Graph Save
    notes = list(ws.Notes)  # Captures the Workspace Note objects and casts to a list
    
    notesList,catchList = [],[]
    for line in notes:
        catchList.append(line.Text) # Get's the Text content of each Note

    keys = ["OFFICE: ", "AUTHOR NAME: ", "AUTHOR EMAIL: ", "TESTED ON: ", "RATING: ", "KEYWORDS: "] # Template data to export

    for k in keys:  # Captures only the relevant Note Data based around a colon split
        for n in catchList:
            if k in n:
                notesList.append(n.split(':')[-1])
            else:
                pass
                
    dataOffice = notesList[0]
    dataAuthorName = notesList[1]
    dataAuthorEmail = notesList[2]
    dataTestedOn = notesList[3]
    dataRating = notesList[4]
    dataKeywords = notesList[5]
    
    appName = revitApp.VersionName # Gets the Revit Version 
    appNumber = revitApp.VersionNumber # Gets the Revit Version Number
    appBuild = revitApp.VersionBuild # Gets the Revit Version Build
    appLanguage = str(revitApp.Language) # Gets the Revit Language
    
    # Getting Physical Memory (RAM) of Machine
    process = os.popen('wmic memorychip get capacity')
    result = process.read()
    process.close()
    totalMem = 0
    
    for m in result.split(" \r\n")[1:-1]:
        totalMem += int(m)
    
    machineRam = totalMem / (1024**3) # Gets the Machines Ram
    
    # Machine data
    userName = Environment.UserName # Gets the Username
    machineName = Environment.MachineName # Gets the Machines Name
    machineOS = Environment.OSVersion # Gets the OS Version
    machineProcessor = Environment.ProcessorCount # Gets the Machines Processor Count
    machineVersion = Environment.Version # Gets the Machines Version
    

    summary = {
                "Machine" :
                    {
                    "Username" : userName,
                    "Name" : machineName,
                    "OS" : machineOS,
                    "Processor Count" : machineProcessor,
                    "Version" : machineVersion,
                    "RAM" : machineRam
                    },
                "Dynamo" :
                    {
                    "Path" : dynpath,
                    "Name" : dynname,
                    "Node Count" : nodeCount,
                    "Wire Count" : wireCount,
                    "Last Saved" : lastSave
                    },
                "Revit" :
                    {
                    "Version Name" : appName,
                    "Version Number" : appNumber,
                    "Version Build" : appBuild,
                    "Language" : appLanguage,
                    "Revit Document" : revitDoc
                    },
                "Graph Notes" :
                    {
                    "Office" : dataOffice,
                    "Author Name" : dataAuthorName,
                    "Author Email" : dataAuthorEmail,
                    "Last Tested On" : dataTestedOn,
                    "Rating" : dataRating,
                    "Keywords" : dataKeywords
                    }
                }

except Exception as ex:
    summary = ex.message

###############################################################################################################################
###########             CHANGE THE FILE PATH AND FILE NAME TO THE SHARED LOCATION               ###############################
###############################################################################################################################
tracker = Path.Combine(Environment.GetFolderPath(Environment.SpecialFolder.Desktop), 'DynamoTracker_' + userName + '.csv')

trace = [userName, machineName, machineOS, machineProcessor, machineRam,
         machineVersion, appName, appNumber, appBuild, appLanguage, revitDoc, 
         dynname, dynpath, lastSave, nodeCount, wireCount, dataOffice, 
         dataAuthorName, dataAuthorEmail, dataTestedOn, dataRating, dataKeywords]

headers = ['User: Username', 'Machine: Name', 'Machine: Operating System', 'Machine: Processor', 
            'Machine: RAM', 'Machine: Version','Application: Name', 'Application: Version', 
            'Application: Build Number', 'Application: Language', 'Application: Document Path', 
            'Graph: Name', 'Graph: Path', 'Graph: Last Saved', 'Graph: Node Count', 
            'Graph: Wire Count', 'Info: Office', 'Info: Author Name', 'Info: Author Email', 
            'Info: Tested On', 'Info: Rating', 'Info: Keywords']

if os.path.isfile(tracker):
    with open(tracker, 'ab') as f:
        writer = csv.writer(f, dialect='excel')
        writer.writerow(trace)
else:
    with open(tracker, 'ab') as f:
        writer = csv.writer(f, dialect='excel')
        writer.writerow(headers)
        writer.writerow(trace)
trace = []

OUT = summary
# ----------------------------------------
