# Dynamo graph Strategy_AppendRunsToFile.dyn (Dynamo 2.1.0.7500)

# group: Write to desktop for now, can be another location
python_script_desktoplocation = Python()  # unwired: IN[0]
# ---------- python_script_desktoplocation.python (6 lines) ----------
#from https://stackoverflow.com/questions/34275782/how-to-get-desktop-location
import clr

import os

OUT = os.path.join(os.path.join(os.environ['USERPROFILE']), 'Desktop\FileRuns.txt') 
# ----------------------------------------

# group: Gets the current time and formats it to our liking
now = DateTime.Now()
custom_time_format = CodeBlock { "yyyMMdd-hh:mmtt"; }
format = DateTime.Format(dateTime=now, format=custom_time_format)

# group: Python script to get the current windows user's login name
# note: this being a python script elimates package dependencies
python_script_getcurrentusername = Python()  # unwired: IN[0]
# ---------- python_script_getcurrentusername.python (5 lines) ----------
import clr

import getpass

OUT = getpass.getuser()
# ----------------------------------------

# group: Join the run time and username
code_block = CodeBlock(ranTime=format, userName=python_script_getcurrentusername) { ranTime + " - " + userName; }

# group: Write the file
appendText = FileSystem.AppendText(filePath=python_script_desktoplocation, text=code_block)

# group: Information
msdn_format_strings_for_date_and = CodeBlock { "https://docs.microsoft.com/en-us/dotnet/standard/base-types/custom-date-and-time-format-strings"; }  # "MSDN Format Strings for Date and Time"
