# Dynamo graph 02_Adding level number to room number.dyn "Adding level number to room number.DYN" (Dynamo 2.2.1.5175)

# group: Getting all rooms
# note: Script Name: Adding level number to room number.DYN
# Packages used in this script:
# TimeStamp : 2019/11/18 4:24
categories = Categories("OST_Rooms")
all_elements_of_category = ElementsOfCategory(Category=categories)

# group: Getting room numbers
code_block = CodeBlock { "Number"; }
getParameterValueByName = Element.GetParameterValueByName(element=all_elements_of_category, parameterName=code_block)

# group: Getting room levels
code_block_2 = CodeBlock { "Level"; }
getParameterValueByName_2 = Element.GetParameterValueByName(element=all_elements_of_category, parameterName=code_block_2)

# group: Getting level numbers from their names
code_block_3 = CodeBlock { "-"; }
split = String.Split(str=getParameterValueByName_2, separator0=code_block_3)
firstItem = List.FirstItem(list=split@L2)

# group: Composing the new room members
code_block_4 = CodeBlock(levelNumber=firstItem, roomNumber=getParameterValueByName) { levelNumber + "- " + roomNumber; }

# group: Setting the new rooms numbers
setParameterByName = Element.SetParameterByName(element=all_elements_of_category, parameterName=code_block, value=code_block_4)
