# Dynamo graph 02_Placing piles on topo.dyn (Dynamo 2.2.1.5175)

# group: Selecting the piles
select_model_elements = DSModelElementsSelection()  # 20 picked in the model

# group: Getting pile locations
getLocation = Element.GetLocation(element=select_model_elements)

# group: Selecting the Topography
# note: Script Name: 02_Placing piles on topo.dyn
# Packages used in this script:
# TimeStamp : 2019/11/18 4:50
select_model_element = DSModelElementSelection()  # 1 picked in the model

# group: Getting topo geometry
geometry = Element.Geometry(element=select_model_element)
lastItem = List.LastItem(list=geometry)
ꟿ_mesh_topolysurface = Custom[ꟿ Mesh.ToPolySurface](mesh=lastItem)  # Converts a Dynamo mesh to a polysurface. By default the node is single threaded, but if you specify a higher number of threads in the `NUMTHREAD` input, the node will run multi-threaded to speed up the conversion. *WARNING* Using multi-threaded code with Dynamo's geometry kernel may crash Revit in some cases.
flatten = List.Flatten(list=ꟿ_mesh_topolysurface)

# group: Projecting pile location onto topography
ZAxis = Vector.ZAxis()
project = Point.Project(point=getLocation, baseGeometry=flatten, projectionDirection=ZAxis, lacing=Longest)
flatten_2 = List.Flatten(list=project)

# group: Calculating offset
Z = Point.Z(point=flatten_2)
Z_2 = Point.Z(point=getLocation)
sub = Z - Z_2

# group: Setting pile offset
code_block = CodeBlock { "Height Offset From Level"; }
setParameterByName = Element.SetParameterByName(element=select_model_elements, parameterName=code_block, value=sub)
