# Dynamo graph 01_RemoveUnusedRoomSeparators_End.dyn (Dynamo 2.2.1.5175)

# group: Annotation
# note: For notes and titles

# group: To Revit
# note: For changes made to Revit

# group: Control
# note: For sliders and other options

# group: Input
# note: For selection and whatnot

# group: Background
# note: For workflow

# group: Required packages
# note: Clockwork v.2.1.2
# spring nodes v.203.1.0
# Rhythm v.2019.11.7

# group: All room separators
categories = Categories("OST_RoomSeparationLines")
all_elements_of_category = ElementsOfCategory(Category=categories)

# group: Get ones bounding rooms
categories_2 = Categories("OST_Rooms")
all_elements_of_category_2 = ElementsOfCategory(Category=categories_2)
# note: Custom Node: Clockwork v.2.1.2
boundaries = Custom[Clockwork.Room.Boundaries](room=all_elements_of_category_2)  # Gets a list of all boundaries of a given room or area and a corresponding list of the elements that are generating those boundaries.
flatten = List.Flatten(list=boundaries.elements)
uniqueItems = List.UniqueItems(list=flatten)

# group: The ones not doin' nothin'
setDifference = List.SetDifference(list1=all_elements_of_category, list2=uniqueItems)

# group: Deletes them
# note: Custom Node: spring nodes v.203.1.0
deleteElements = Custom[Springs.Doc.DeleteElements](element=setDifference)  # Attempts to delete the input list of elements from the active Revit document.The node returns the number of successfully deleted elements and their Ids as a string. Carefully observe the deleted elements count. It may be greater than the input list because hosted elements or tags will be deleted as well. If an element in the list can not be deleted (for example last revision or last view), the whole list will fail to be deleted.; unwired: confirm

# group: The result in a generic manner
string = StringInput("Result: {0} {1} deleted.")

# group: Generate quantity feedback
code_block = CodeBlock { "Room Separator"; }
count = List.Count(list=setDifference)
# note: Custom Node: Rhythm v.2019.11.7
ʳʰʸᵗʰᵐ_modify_toquantity = Rhythm.String.Modify.ToQuantity(str=code_block, quantity=count)

# group: Option to delete or just view count
delete = BoolSelector(false)  # graph input

# group: Arguments to format string with
code_block_2 = CodeBlock { "have been"; "to be"; }
if_ = If(test=delete, true=code_block_2.out0, false=code_block_2.out1)
list_create = List.Create(item0=ʳʰʸᵗʰᵐ_modify_toquantity, item1=if_)

# group: Formats the result with the case as it is now.
# note: Custom Node: Rhythm v.2019.11.7
ʳʰʸᵗʰᵐ_modify_formatwith = Rhythm.String.Modify.FormatWith(str=string, args=list_create)
result = Watch(ʳʰʸᵗʰᵐ_modify_formatwith)
