# Dynamo graph 02_ThreeDeeRoomTags_End.dyn (Dynamo 2.2.1.5175)

# group: Input
# note: For selection and whatnot

# group: Background
# note: For workflow

# group: Control
# note: For sliders and other options

# group: To Revit
# note: For changes made to Revit

# group: Annotation
# note: For notes and titles

# group: Info
# note: For general Information

# group: Other
# note: For general other needs

# group: Info
# note: Making a script shippable isn't just about Dynamo player. It is also about considering changes between versions.

# group: How to get the hardcoded value
family_types = FamilyTypes("AU2019_3DRoomTag:Name, Number")
name = Element.Name(element=family_types)
sendTo = Custom[Clipboard.SendTo](str=name)  # Copies a string to the clipboard.

# group: Collect all rooms by category
code_block = CodeBlock { "Rooms"; }
byName = Category.ByName(name=code_block)
all_elements_of_category = ElementsOfCategory(Category=byName)

# group: Filter out unplaced rooms
code_block_2 = CodeBlock { "Area"; }
getParameterValueByName = Element.GetParameterValueByName(element=all_elements_of_category, parameterName=code_block_2)
code_block_3 = CodeBlock { ""; }
ne = getParameterValueByName != code_block_3
filterByBoolMask = List.FilterByBoolMask(list=all_elements_of_category, mask=ne)

# group: Points to place the 3d room tags
getLocation = Element.GetLocation(element=filterByBoolMask.in)

# group: Place the 3d Room Tags
code_block_4 = CodeBlock { "Name, Number"; }
byName_2 = FamilyType.ByName(name=code_block_4)
byPoint = FamilyInstance.ByPoint(familyType=byName_2, point=getLocation)

# group: Collect the data for the 3d room tags
code_block_5 = CodeBlock { "Name"; "Number"; "RoomId"; }
code_block_6 = CodeBlock(rooms=filterByBoolMask.in) { rooms; }
getParameterValueByName_2 = Element.GetParameterValueByName(element=code_block_6, parameterName=code_block_5.out0)
getParameterValueByName_3 = Element.GetParameterValueByName(element=code_block_6, parameterName=code_block_5.out1)
id = Element.Id(element=code_block_6)

# group: Set the 3d room tag's parameters. I like to do this sequentially because it is easier to dissect.
setParameterByName = Element.SetParameterByName(element=byPoint, parameterName=code_block_5.out0, value=getParameterValueByName_2)
setParameterByName_2 = Element.SetParameterByName(element=setParameterByName, parameterName=code_block_5.out1, value=getParameterValueByName_3)
setParameterByName_3 = Element.SetParameterByName(element=setParameterByName_2, parameterName=code_block_5.out2, value=id)
