# Dynamo graph 03_LoadViewTemplatesFromResourceFile_End.dyn "03_LoadViewTemplatesFromResourceFile" (Dynamo 2.2.1.5175)

# group: Annotation
# note: For notes and titles

# group: To Revit
# note: For changes made to Revit

# group: Control
# note: For sliders and other options

# group: Input
# note: For selection and whatnot

# group: Background
# note: For workflow

# group: Builds the File Path UI to Choose Seed File
# note: Rhythm v.2019.11.7
# Data-Shapes v.2019.2.40
# Clockwork v.2.1.2
code_block = CodeBlock()
# ---------- code_block.designscript (2 lines) ----------
//Description
"Pick File to Get View Templates From";
# ----------------------------------------
file_path = Filename("_resources\au_2019.png")
code_block_2 = CodeBlock { "Get View Templates"; }
code_block_3 = CodeBlock { "View Template Seed File"; }
# note: Custom Node: Data-Shapes v.2019.2.40
ui_filepath_data = Custom[UI.FilePath Data](InputName=code_block_3)  # Create filepath input for UI.MultipleInputForm ++ . Check out www.data-shapes.net for more infos !
boolean = BoolSelector(true)
ui_multipleinputform = Custom[UI.MultipleInputForm ++](Description_optional=code_block, Logo_optional=file_path, ButtonText_optional=code_block_2, Inputs=ui_filepath_data, Toggle=boolean)  # Create a form with multiple inputs. see www.data-shapes.net for tutorials and infos!

# group: Background Open Revit File for Processing
# note: Custom Node: Rhythm v.2019.11.7
ʳʰʸᵗʰᵐ_applications = Rhythm.Revit.Application.Applications.OpenDocumentFile(filePath=ui_multipleinputform.User_Inputs)

# group: Obtain the view templates by filtering out all views.
element_types = ElementTypes("View")
# note: Custom Node: Rhythm v.2019.11.7
elementsOfTypeInDocument = Rhythm.Revit.Selection.Collector.ElementsOfTypeInDocument(document=ʳʰʸᵗʰᵐ_applications, elementType=element_types)
flatten = List.Flatten(list=elementsOfTypeInDocument)
# note: Custom Node: Clockwork v.2.1.2
isViewTemplate = Custom[View.IsViewTemplate+](view=flatten)  # Checks if a given view is a view template. Unlike the OOTB node it works for all view types.
filterByBoolMask = List.FilterByBoolMask(list=flatten, mask=isViewTemplate)

# group: Build selection window of View Templates
code_block_4 = CodeBlock { "View Templates (Seed File)"; }
name = Element.Name(element=filterByBoolMask.in)
code_block_5 = CodeBlock { false; }
# note: Custom Node: Data-Shapes v.2019.2.40
ui_listview_data = Custom[UI.Listview Data](InputName=code_block_4, Keys=name, Values=filterByBoolMask.in, ShowId_optionnal=code_block_5)  # Create data for ListView input in UI.MultiInputForm ++ . Check out www.data-shapes.net for more infos.

# group: Builds UI to Choose View Templates
code_block_6 = CodeBlock { "Please Select View Templates to Transfer"; }
boolean_2 = BoolSelector(true)
code_block_7 = CodeBlock { "Cancel"; }
# note: Custom Node: Data-Shapes v.2019.2.40
ui_multipleinputform_2 = Custom[UI.MultipleInputForm ++](Description_optional=code_block_6, Logo_optional=file_path, Inputs=ui_listview_data, Toggle=boolean_2, CancelButtonText_optional=code_block_7)

# group: Copy View Templates
# note: Custom Node: Rhythm v.2019.11.7
ʳʰʸᵗʰᵐ_documents = Rhythm.Revit.Application.Documents.CopyElementsFromDocument(sourceDocument=ʳʰʸᵗʰᵐ_applications, elements=ui_multipleinputform_2.User_Inputs)

# group: Close the document out of memory
# note: Custom Node: Clockwork v.2.1.2
passthrough = Custom[Passthrough](passThrough=ʳʰʸᵗʰᵐ_applications, waitFor=ʳʰʸᵗʰᵐ_documents)  # Forces a sequential order of execution. The node wired into the output of the Passthrough node will be executed *after* the node wired into the waitFor input (e.g. important for some Revit operations). The value of the passThrough input will be passed on to the node wired into the output port of the Passthrough node.
code_block_8 = CodeBlock { false; }
# note: Custom Node: Rhythm v.2019.11.7
ʳʰʸᵗʰᵐ_applications_2 = Rhythm.Revit.Application.Applications.CloseDocument(document=passthrough, save=code_block_8)

# group: Builds feedback
code_block_9 = CodeBlock { "How many view templates were copied?"; }
code_block_10 = CodeBlock { "View Template"; }
flatten_2 = List.Flatten(list=ʳʰʸᵗʰᵐ_documents)
count = List.Count(list=flatten_2)
ʳʰʸᵗʰᵐ_modify_toquantity = Rhythm.String.Modify.ToQuantity(str=code_block_10, quantity=count)
ui_textnote_data = Custom[UI.TextNote Data](Title=code_block_9, TextNote=ʳʰʸᵗʰᵐ_modify_toquantity)  # Create Data for TextNote input in UI.MultipleInputForm ++ . Check out www.data-shapes.net for more informations
file_path_2 = Filename("_resources\carlton.gif")
ui_image_data = Custom[UI.Image Data](Image=file_path_2)  # Places an image on UI.MultipleInutForm ++ .
list_create = List.Create(item0=ui_textnote_data, item1=ui_image_data)
code_block_11 = CodeBlock { true; 200; }
ui_multipleinputform_3 = Custom[UI.MultipleInputForm ++](Logo_optional=file_path, Inputs=list_create, Toggle=code_block_11.out0, Width_optional=code_block_11.out1)
