# Dynamo graph 04_KingStudPlacer_End.dyn (Dynamo 2.2.1.5175)

# group: Input
# note: For selection and whatnot

# group: Background
# note: For workflow

# group: Control
# note: For sliders and other options

# group: To Revit
# note: For changes made to Revit

# group: Annotation
# note: For notes and titles

# group: Info
# note: For general Information

# group: Other
# note: For general other needs

code_block = CodeBlock { "Doors"; }
byName = Category.ByName(name=code_block)
all_elements_of_category = ElementsOfCategory(Category=byName)

# group: Obtain the host (Wall), it's type and the kind as classified by Revit
host = Custom[Element.Host+](element=all_elements_of_category)  # Gets an element's host. Unlike the OOTB node FamilyInstance.GetHost it not only works for family instances but also for elements like wall sweeps, foundations, railings, builing pads and topo subregions.
elementType = Element.ElementType(element=host)
kind = Custom[WallType.Kind](wallType=elementType)  # Retrieves the wall kind of a given wall type

# group: Filter out curtain wall doors
code_block_2 = CodeBlock { "Curtain"; }
ne = kind != code_block_2

# group: Also filter for interior walls
function = Custom[FamilyType.Function](familyType=elementType)  # Retrieves the Function property of a given family type (if it has that property)
code_block_3 = CodeBlock { "Interior"; }
eq = function == code_block_3

and_ = ne && eq

# group: Annotation
filterByBoolMask = List.FilterByBoolMask(list=host, mask=and_)
filterByBoolMask_2 = List.FilterByBoolMask(list=all_elements_of_category, mask=and_)

# group: The family to place
family_types = FamilyTypes("08_KingStud:08_KingStud")

# group: Point location for hosting familyinstances
getLocation = Element.GetLocation(element=filterByBoolMask_2.in)

# group: Place the king studs
ꟿ_familyinstance_byhostandpoint = Custom[ꟿ FamilyInstance.ByHostAndPoint](host=filterByBoolMask.in, type=family_types, point=getLocation)  # Creates hosted family instances(doors/windows) at the specified points. You can feed either a single family type or a unique type for each instance.

# group: Get the door width (Type or Instance)
code_block_4 = CodeBlock { "Width"; }
ʳʰʸᵗʰᵐ_elements = Rhythm.Revit.Elements.Elements.GetParameterValueByNameTypeOrInstance(element=filterByBoolMask_2.in, parameterName=code_block_4)

# group: To Revit
setParameterByName = Element.SetParameterByName(element=ꟿ_familyinstance_byhostandpoint, parameterName=code_block_4, value=ʳʰʸᵗʰᵐ_elements)

# group: Set the height of the studs
code_block_5 = CodeBlock { "Height"; }
code_block_6 = CodeBlock { "Unconnected Height"; }
getParameterValueByName = Element.GetParameterValueByName(element=filterByBoolMask.in, parameterName=code_block_6)
setParameterByName_2 = Element.SetParameterByName(element=setParameterByName, parameterName=code_block_5, value=getParameterValueByName)
