# Dynamo graph ChangeFonts.dyn (Dynamo 2.2.1.5175)

# group: Input
# note: For selection and whatnot

# group: Background
# note: For workflow

# group: Control
# note: For sliders and other options

# group: To Revit
# note: For changes made to Revit

# group: Annotation
# note: For notes and titles

# group: Info
# note: For general Information

# group: Other
# note: For general other needs

# group: Collect the text notes
element_types = ElementTypes("TextNoteType")
all_elements_of_type = ElementsOfType(element_type=element_types)

code_block = CodeBlock { "Text Font"; }
py_get_fonts = Python()  # unwired: IN[0]
# ---------- py_get_fonts.python (13 lines) ----------
#http://www.ironpython.info/index.php?title=Enumerating_Installed_Fonts
import clr
clr.AddReference("System.Drawing")
from System.Drawing.Text import InstalledFontCollection

fontCollection = InstalledFontCollection()
# make a list to return the fonts
fontsToUse = []
# iterate through and add to list
for font in fontCollection.Families:
    fontsToUse.append(font.Name)
# return our list for our use
OUT = fontsToUse
# ----------------------------------------
code_block_2 = CodeBlock { "Comic Sans MS"; }
indexOf = List.IndexOf(list=py_get_fonts, element=code_block_2)
ui_dropdown_data = Custom[UI.DropDown Data](Keys=py_get_fonts, Values=py_get_fonts, DefaultValueIndex=indexOf)  # Create data for DropDown input in UI.MultiInputForm ++ . Check out www.data-shapes.net for more infos.
code_block_3 = CodeBlock { true; }
ui_multipleinputform = Custom[UI.MultipleInputForm ++](Inputs=ui_dropdown_data, Toggle=code_block_3)  # Create a form with multiple inputs. see www.data-shapes.net for tutorials and infos!
firstItem = List.FirstItem(list=ui_multipleinputform.User_Inputs)
setParameterByName = Element.SetParameterByName(element=all_elements_of_type, parameterName=code_block, value=firstItem)
ʳʰʸᵗʰᵐ_collector = Rhythm.Revit.Selection.Collector.ElementsOfTypeInDocument()  # unwired: document, elementType
