# Dynamo graph FromToRoom.dyn (Dynamo 2.2.1.5175)

code_block = CodeBlock { "Doors"; }
byName = Category.ByName(name=code_block)
all_elements_of_category = ElementsOfCategory(Category=byName)

# group: Obtain the potential room. Starting with where it opens to.
rooms = Custom[Door.Rooms](door=all_elements_of_category)  # Gets the rooms that are connected by a given door
isNull = Object.IsNull(obj=rooms.toRoom)
if_ = If(test=isNull, true=rooms.fromRoom, false=rooms.toRoom)
number = Room.Number(room=if_)

groupByKey = List.GroupByKey(list=all_elements_of_category, keys=number)
code_block_2 = CodeBlock { "Mark"; }
getParameterValueByName = Element.GetParameterValueByName(element=groupByKey.groups, parameterName=code_block_2)

# group: Background
code_block_3 = CodeBlock { 1; }
count = List.Count(list=groupByKey.groups@L2)
ne = code_block_3 != count
code_block_4 = CodeBlock { true; }
byNumber = Custom[AlphabeticalSequence.ByNumber](n=count, upperCase=code_block_4)  # Creates a list of the first N letters of the alphabet (where 1 = A, 2 = B, ... , 27 = AA, 28 = AB etc.).
code_block_5 = CodeBlock { ""; }
if_2 = If(test=ne, true=byNumber, false=code_block_5)

add = groupByKey.unique_keys + if_2
list_create = List.Create(item0=groupByKey.groups, item1=getParameterValueByName, item2=add)
flatten = List.Flatten(list=list_create@L3)
code_block_6 = CodeBlock(doors=flatten) { doors[0]; }
code_block_7 = CodeBlock { ["Door","Current Mark","Potential Mark: ToRoom"]; }
transpose = List.Transpose(lists=flatten)
addItemToFront = List.AddItemToFront(item=code_block_7, list=transpose)
code_block_8 = CodeBlock { true; }
ui_datatable_input = Custom[UI.DataTable input](Data=addItemToFront, FirstRowIsTitles=code_block_8)  # Create a DataTable view input for UI.MultipleInputForm ++
code_block_9 = CodeBlock { true; }
code_block_10 = CodeBlock { 800; 600; }
ui_multipleinputform = Custom[UI.MultipleInputForm ++](Inputs=ui_datatable_input, Toggle=code_block_9, MaxHeight_optional=code_block_10.out0, Width_optional=code_block_10.out1)  # Create a form with multiple inputs. see www.data-shapes.net for tutorials and infos!
code_block_11 = CodeBlock(output=ui_multipleinputform.User_Inputs) { output[0]; }
deconstruct = List.Deconstruct(list=code_block_11)
code_block_12 = CodeBlock { 2; }
getItemAtIndex = List.GetItemAtIndex(list=deconstruct.rest@L2, index=code_block_12)
setParameterByName = Element.SetParameterByName(element=code_block_6, parameterName=code_block_2, value=getItemAtIndex)
