# Dynamo graph 2018-UKDynamoDay_01.1_DynamoPlayer_End.dyn (Dynamo 2.0.2.6826)

# group: Annotation
# note: For notes and titles

# group: To Revit
# note: For changes made to Revit

# group: Control
# note: For sliders and other options

# group: Input
# note: For selection and whatnot

# group: Background
# note: For workflow

# group: Host View Template
view_template_to_get_filters = ViewTemplatesUi(index=4)  # "View Template to Get Filters From"; graph input

# group: Child View Template
view_template_to_send_filters_to = ViewTemplatesUi(index=1)  # graph input

# group: Get the filters and overrides
filters = View.Filters(view=view_template_to_send_filters_to)
filterOverrides = View.FilterOverrides(view=view_template_to_send_filters_to, parameterFilter=filters)

# group: Add filter to view
addFilter = View.AddFilter(view=view_template_to_get_filters, parameterFilter=filters)

# group: Set the overrides
code_block = CodeBlock { true; }
setFilterOverrides = View.SetFilterOverrides(view=addFilter, parameterFilter=filters, overrides=filterOverrides, hide=code_block)
