# Dynamo graph 2018-UKDynamoDay_01.2_DynamoPlayer_End.dyn (Dynamo 2.0.2.6826)

# group: Annotation
# note: For notes and titles

# group: To Revit
# note: For changes made to Revit

# group: Control
# note: For sliders and other options

# group: Input
# note: For selection and whatnot

# group: Background
# note: For workflow

# group: Builds the File Path UI to Choose Seed File
code_block = CodeBlock()
# ---------- code_block.designscript (2 lines) ----------
//Description
"Pick File to Get View Templates From";
# ----------------------------------------
file_path = Filename("Resources\logo.png")  # graph input
code_block_2 = CodeBlock { "Get View Templates"; }
code_block_3 = CodeBlock { "View Template Seed File"; }
ui_filepath_data = Custom[UI.FilePath Data](InputName=code_block_3)  # Create filepath input for UI.MultipleInputForm ++ . Check out www.data-shapes.net for more infos !
boolean = BoolSelector(true)  # graph input
code_block_4 = CodeBlock { "Cancel"; }
ui_multipleinputform = Custom[UI.MultipleInputForm ++](Description_optional=code_block, Logo_optional=file_path, ButtonText_optional=code_block_2, Inputs=ui_filepath_data, Toggle=boolean, CancelButtonText_optional=code_block_4)  # Create a form with multiple inputs. see www.data-shapes.net for tutorials and infos!

# group: Background Open Revit File for Processing
openDocumentFile = Rhythm.Revit.Application.Applications.OpenDocumentFile(filePath=ui_multipleinputform.User_Inputs)

# group: Obtain the view templates by filtering out all views.
element_types = ElementTypes(index=329)
elementsOfTypeInDocument = Rhythm.Revit.Selection.Collector.ElementsOfTypeInDocument(document=openDocumentFile, elementType=element_types)
flatten = List.Flatten(list=elementsOfTypeInDocument)
isViewTemplate = Custom[View.IsViewTemplate+](view=flatten)  # Checks if a given view is a view template. Unlike the OOTB node it works for all view types.
filterByBoolMask = List.FilterByBoolMask(list=flatten, mask=isViewTemplate)

# group: Build selection window of View Templates
code_block_5 = CodeBlock { "View Templates (Seed File)"; }
name = Element.Name(element=filterByBoolMask.in)
code_block_6 = CodeBlock { false; }
ui_listview_data = Custom[UI.Listview Data](InputName=code_block_5, Keys_var=name, Values_var=filterByBoolMask.in, ShowId_optionnal=code_block_6)  # Create data for ListView input in UI.MultiInputForm ++ . Check out www.data-shapes.net for more infos.

# group: Builds UI to Choose View Templates
code_block_7 = CodeBlock { "Please Select View Templates to Transfer"; }
boolean_2 = BoolSelector(true)
code_block_8 = CodeBlock { "Cancel"; }
ui_multipleinputform_2 = Custom[UI.MultipleInputForm ++](Description_optional=code_block_7, Logo_optional=file_path, Inputs=ui_listview_data, Toggle=boolean_2, CancelButtonText_optional=code_block_8)

# group: Copy View Templates
copyElementsFromDocument = Rhythm.Revit.Application.Documents.CopyElementsFromDocument(sourceDocument=openDocumentFile, elements=ui_multipleinputform_2.User_Inputs)

# group: Close the document out of memory
passthrough = Custom[Passthrough](passThrough=openDocumentFile, waitFor=copyElementsFromDocument)  # Forces a sequential order of execution. The node wired into the output of the Passthrough node will be executed *after* the node wired into the waitFor input (e.g. important for some Revit operations). The value of the passThrough input will be passed on to the node wired into the output port of the Passthrough node.
code_block_9 = CodeBlock { false; }
ʳʰʸᵗʰᵐ_applications = Rhythm.Revit.Application.Applications.CloseDocument(document=passthrough, save=code_block_9)
