# Dynamo graph 2018-UKDynamoDay_04.1_CustomPackages_End.dyn (Dynamo 2.0.2.6826)

string = StringInput("102")  # graph input

# group: This builds the dictionary and grabs elements from it based on a key. In our case this will be room name.
categories = Categories(index=403)  # graph input
all_elements_of_category = ElementsOfCategory(Category=categories)
code_block = CodeBlock { "Number"; }
getParameterValueByName = Element.GetParameterValueByName(element=all_elements_of_category, parameterName=code_block)
code_block_2 = CodeBlock(rooms=all_elements_of_category, roomNumbers=getParameterValueByName) { roomDictionary = []; roomDictionary[roomNumbers] = rooms; }
code_block_3 = CodeBlock(roomDic=code_block_2.roomDictionary, key=string) { roomDic[key]; }
