# Dynamo graph 2018-UKDynamoDay_04.3_CustomPackages_End.dyn (Dynamo 2.0.2.6826)

select_model_element = DSModelElementSelection()  # 1 picked in the model; graph input
code_block = CodeBlock { "test"; }
python_script = Python(IN[0]=select_model_element, IN[1]=code_block)
# ---------- python_script.python (24 lines) ----------
#this imports the default libraries
import clr
#adds the revit api
clr.AddReference('RevitAPI')
from Autodesk.Revit.DB import *
#adds the ability to use "transactions"
clr.AddReference("RevitServices")
import RevitServices
from RevitServices.Persistence import DocumentManager
from RevitServices.Transactions import TransactionManager
#the current revit file
doc = DocumentManager.Instance.CurrentDBDocument
#the internal value of the dimension
item = UnwrapElement(IN[0])
#the above value
name = IN[1]
#start the change
TransactionManager.Instance.EnsureInTransaction(doc)
#set the above value
item.Above = name
#end the change
TransactionManager.Instance.TransactionTaskDone()
#output something
OUT = name
# ----------------------------------------
