# Dynamo graph 2018-UKDynamoDay_04.4_CustomPackages_End.dyn (Dynamo 2.0.2.6826)

# group: Annotation
# note: For notes and titles

# group: To Revit
# note: For changes made to Revit

# group: Control
# note: For sliders and other options

# group: Input
# note: For selection and whatnot

# group: Background
# note: For workflow

# group: Get the Rooms in the current view
categories = Categories(index=403)  # graph input
current = Document.Current()
# note: Archi-Lab_Grimshaw
activeView = Document.ActiveView(document=current)
byCategoryAndView = archilab.Revit.Selection.Select.ByCategoryAndView(category=categories, view=activeView)

# group: Select the Spline
select_model_element = DSModelElementSelection()  # nothing selected; graph input
curve = CurveElement.Curve(curveElement=select_model_element)

# group: Filter for rooms that touch the spline (and also find the piece of the spline that passes through each room)
geometry = Element.Geometry(element=byCategoryAndView)
flatten = List.Flatten(list=geometry)
intersect = Geometry.Intersect(geometry=flatten, other=curve)
isEmpty = List.IsEmpty(list=intersect@L2)
# note: Room elements that touch the spline
filterByBoolMask = List.FilterByBoolMask(list=byCategoryAndView, mask=isEmpty)
# note: Part of the spline that passes through each room
filterByBoolMask_2 = List.FilterByBoolMask(list=intersect, mask=isEmpty)
# note: First of possibly multiple intersections
firstItem = List.FirstItem(list=filterByBoolMask_2.out@L2)

# group: Sort the room elements along the spline
# note: For the piece of the spline that belongs to each room, find the location of its start point along the original spline.
# To do this, find the parameter along the original spline where each room-point lies, which will be a number between 0 and 1.
pointAtParameter = Curve.PointAtParameter(curve=firstItem)
parameterAtPoint = Curve.ParameterAtPoint(curve=curve, point=pointAtParameter)
sortIndexByValue = List.SortIndexByValue(list=parameterAtPoint)
getItemAtIndex = List.GetItemAtIndex(list=filterByBoolMask.out, index=sortIndexByValue)

# group: Start #
code_block = CodeBlock { 400; }

# group: New # Sequence
count = List.Count(list=getItemAtIndex)
code_block_2 = CodeBlock { 1; }
sequence = Sequence(start=code_block, amount=count, step=code_block_2, lacing=Longest)
string_from_object = FromObject(obj=sequence)

# group: Set the value in Revit
code_block_3 = CodeBlock { "Number"; }
setParameterByName = Element.SetParameterByName(element=getItemAtIndex, parameterName=code_block_3, value=string_from_object)
