# Dynamo graph 2018-UKDynamoDay_05.1_Animation_End.dyn (Dynamo 2.0.2.6826)

# group: Control
# note: For sliders and other options

# group: To Revit
# note: For changes made to Revit

# group: Annotation
# note: For notes and titles

# group: Input
# note: For selection and whatnot

# group: Background
# note: For workflow

# group: Family types and parameter values
family_types = FamilyTypes()  # nothing selected; graph input
all_elements_of_family_type = ElementsOfFamilyType(Family_Type=family_types)
code_block = CodeBlock { "3D Swing Angle"; 0; 90; 20; }
string = StringInput("\\prlx2\Marketing\Lectures\2018- AULondon-IntermediateDynamoWorkshop\AU-Dynamo-Workshops\AU2018-London-Intermediate-Dynamo-Workshop\05_AnimationStrategiesWithDynamo\Images\Doors\")  # graph input

activeView = Custom[Springs.Doc.ActiveView]()  # Selects the current document's active view. Supports more view types than the built-in option. Will be depreciated once the bult in node works with all plan types.
animateNumericParameter = Rhythm.Revit.Tools.Element.AnimateNumericParameter(element=all_elements_of_family_type, parameterName=code_block.out0, startValue=code_block.out1, endValue=code_block.out2, iterations=code_block.out3, directoryPath=string, view=activeView)
