# Dynamo graph 2018-UKDynamoDay_05.2_Animation_End.dyn (Dynamo 2.0.2.6826)

# group: Control
# note: For sliders and other options

# group: To Revit
# note: For changes made to Revit

# group: Annotation
# note: For notes and titles

# group: Input
# note: For selection and whatnot

# group: Background
# note: For workflow

# group: Choose View to Export
views = Views()  # nothing selected; graph input

# group: Select curtain wall in model.
select_model_element = DSModelElementSelection()  # 1 picked in the model; graph input
byElement = CurtainPanel.ByElement(hostingElement=select_model_element)
asFamilyInstance = CurtainPanel.AsFamilyInstance(curtainPanel=byElement)

# group: Colors to use as start and end
color_palette = ColorPalette({R: 165, G: 42, B: 42, A: 255})
color_palette_2 = ColorPalette({R: 210, G: 105, B: 30, A: 255})
create = List.Create(item0=color_palette, item1=color_palette_2)

# group: Builds the color range to override panels
count = List.Count(list=asFamilyInstance)
code_block = CodeBlock(panels=count) { 0..1..#panels; }
color_range = ColorRange(colors=create, value=code_block)  # unwired: indices

# group: Option Number
integer_slider = IntegerSlider(1, range=1..10 step 1)  # graph input

# group: Randomizes order and builds color settings for each one.
randomizeOrder = Lists.Manage.RandomizeOrder(Data=color_range, Seed=integer_slider)
fill_patterns = FillPatterns()  # nothing selected; graph input
byProperties = Revit.Filter.OverrideGraphicSettings.ByProperties(projectionFillColor=randomizeOrder.Randomized, projectionFillPattern=fill_patterns)

# group: Override in active view.
overrideInView = Element.OverrideInView(element=asFamilyInstance, overrides=byProperties)

passthrough = Custom[Passthrough](passThrough=views, waitFor=overrideInView)  # Forces a sequential order of execution. The node wired into the output of the Passthrough node will be executed *after* the node wired into the waitFor input (e.g. important for some Revit operations). The value of the passThrough input will be passed on to the node wired into the output port of the Passthrough node.
string = StringInput("D:\OneDrive\EvolveLAB Transfer\EvolveLAB\Presentations\AU2017\Dynamo BIM Workshop\Dataset\05_AnimationStrategiesWithDynamo\Images\ColorFacade")  # graph input
code_block_2 = CodeBlock(path=string, number=integer_slider) { path+"\\"+number+".png"; }
exportAsImage = View.ExportAsImage(view=passthrough, path=code_block_2)
