# Dynamo graph 2018-UKDynamoDay_05.3_Animation_End.dyn (Dynamo 2.0.2.6826)

# group: Background
# note: For workflow

# group: Input
# note: For selection and whatnot

# group: Control
# note: For sliders and other options

# group: To Revit
# note: For changes made to Revit

# group: Annotation
# note: For notes and titles

views = Views()  # nothing selected; graph input

# group: Get curtain panels from wall
select_model_element = DSModelElementSelection()  # 1 picked in the model; graph input
byElement = CurtainPanel.ByElement(hostingElement=select_model_element)
asFamilyInstance = CurtainPanel.AsFamilyInstance(curtainPanel=byElement)

# group: Find the random panels in the file to use.
element_types = ElementTypes(index=121)  # graph input
all_elements_of_type = ElementsOfType(element_type=element_types)
name = Element.Name(element=all_elements_of_type)
code_block = CodeBlock { "Random"; }
startsWith = String.StartsWith(str=name, searchFor=code_block)
filterByBoolMask = List.FilterByBoolMask(list=all_elements_of_type, mask=startsWith)

# group: Cycle the list a bunch of times to have enough of these things.
count = List.Count(list=asFamilyInstance)
cycle = List.Cycle(list=filterByBoolMask.in, amount=count)

# group: The option number
integer_slider = IntegerSlider(1, range=1..10 step 1)  # graph input

# group: Randomize and take the amount you need
randomizeOrder = Lists.Manage.RandomizeOrder(Data=cycle, Seed=integer_slider)
takeItems = List.TakeItems(list=randomizeOrder.Randomized, amount=count)

# group: Set the new option
# note: Wombat
setType = WombatDynamo.FamilyInstance.SetType(familyInstance=asFamilyInstance, familyType=takeItems)

passthrough = Custom[Passthrough](passThrough=views, waitFor=setType)  # Forces a sequential order of execution. The node wired into the output of the Passthrough node will be executed *after* the node wired into the waitFor input (e.g. important for some Revit operations). The value of the passThrough input will be passed on to the node wired into the output port of the Passthrough node.

# group: Build path
string = StringInput("\\prlx2\Marketing\Lectures\2018- AULondon-IntermediateDynamoWorkshop\AU-Dynamo-Workshops\AU2018-London-Intermediate-Dynamo-Workshop\05_AnimationStrategiesWithDynamo\Images\RandomMaterial")  # graph input
code_block_2 = CodeBlock(path=string, number=integer_slider) { path+"\\"+number+".png"; }

exportAsImage = View.ExportAsImage(view=passthrough, path=code_block_2)
