# Dynamo graph 2018-UKDynamoDay_05.4_Animation_End.dyn (Dynamo 2.0.2.6826)

# group: Annotation
# note: For notes and titles

# group: Output
# note: For changes made to Revit

# group: Control
# note: For sliders and other options

# group: Input
# note: For selection and whatnot

# group: Background
# note: For workflow

# group: Build rectangles to extrude
code_block = CodeBlock { 0..100..5; }
byCoordinates = Point.ByCoordinates(x=code_block)
byOriginNormal = Plane.ByOriginNormal(origin=byCoordinates)
code_block_2 = CodeBlock { 3; }
byWidthLength = Rectangle.ByWidthLength(plane=byOriginNormal, width=code_block_2, length=code_block_2)

# group: Build the range and reverse it, then join back into one list
count = List.Count(list=byWidthLength)
code_block_3 = CodeBlock(bars=count) { 5..100..#bars; }
code_block_4 = CodeBlock { 10; }
takeItems = List.TakeItems(list=code_block_3, amount=code_block_4)
reverse = List.Reverse(list=takeItems)
join = List.Join(list0=takeItems, list1=reverse)

# group: Periodically changed the indice to trigger the wave action
code_block_5 = CodeBlock { 0; 20; 5000; }
# note: Firefly
faderOneWay = Firefly.Utility.FaderOneWay(From=code_block_5.out0, To=code_block_5.out1, Time=code_block_5.out2)

# group: Gives the "Wave" effect
shiftIndices = List.ShiftIndices(list=join, amount=faderOneWay)

color_palette = ColorPalette({R: 95, G: 158, B: 160, A: 255})
color_palette_2 = ColorPalette({R: 188, G: 143, B: 143, A: 255})

# group: Build a color range with the applicable amount of colors.
create = List.Create(item0=color_palette, item1=color_palette_2)
code_block_6 = CodeBlock(bars=count) { 0..1..#bars; }
color_range = ColorRange(colors=create, value=code_block_6)  # unwired: indices

# group: Extrudes them and colors accordingly.
extrudeAsSolid = Curve.ExtrudeAsSolid(curve=byWidthLength, distance=shiftIndices)
byGeometryColor = Modifiers.GeometryColor.ByGeometryColor(geometry=extrudeAsSolid, color=color_range)
