# Dynamo graph 2018-UKDynamoDay_05.5_BONUS-generativeBIMZ.dyn (Dynamo 2.0.2.6826)

number_slider = DoubleSlider(17, range=0..50 step 1)  # graph input
code_block = CodeBlock { 150; }
byOrigin = CoordinateSystem.ByOrigin(x=code_block, y=code_block)
code_block_2 = CodeBlock { DSCore.List.Flatten([20,45,15,100,80]); }
code_block_3 = CodeBlock { 0; 4; 10000; }
faderOneWay = Firefly.Utility.FaderOneWay(From=code_block_3.out0, To=code_block_3.out1, Time=code_block_3.out2)
ceiling = Math.Ceiling(number=faderOneWay)
getItemAtIndex = List.GetItemAtIndex(list=code_block_2, index=ceiling)
code_block_4 = CodeBlock { 100; 40; }
byWidthLength = Rectangle.ByWidthLength(cs=byOrigin, width=getItemAtIndex, length=code_block_4.out1)
byPatch = Surface.ByPatch(closedCurve=byWidthLength)
code_block_5 = CodeBlock { 10; 5; }
panelQuad = Geometry.Panel.PanelQuad(srf=byPatch, u=code_block_5.out0, v=code_block_5.out1)
code_block_6 = CodeBlock { 0; 50; 10000; }
faderOneWay_2 = Firefly.Utility.FaderOneWay(From=code_block_6.out0, To=code_block_6.out1, Time=code_block_6.out2)
ceiling_2 = Math.Ceiling(number=faderOneWay_2)
takeItems = List.TakeItems(list=panelQuad.Panels, amount=ceiling_2)
code_block_7 = CodeBlock { 5; }
code_block_8 = CodeBlock { false; }
thicken = Surface.Thicken(surface=takeItems, thickness=code_block_7, both_sides=code_block_8)
code_block_9 = CodeBlock { 1; 10; 20000; 20000; }
faderOneWay_3 = Firefly.Utility.FaderOneWay(From=code_block_9.out0, To=code_block_9.out1, Time=code_block_9.out2, Delay=code_block_9.out3)
ceiling_3 = Math.Ceiling(number=faderOneWay_3)
code_block_10 = CodeBlock(floors=ceiling_3) { 5..#floors..5; }
translate = Geometry.Translate(geometry=thicken@L1, zTranslation=code_block_10)

# group: Choose yo colors
color_palette = ColorPalette({R: 95, G: 158, B: 160, A: 255})
color_palette_2 = ColorPalette({R: 255, G: 99, B: 71, A: 255})
color_palette_3 = ColorPalette({R: 64, G: 224, B: 208, A: 255})
create = List.Create(item0=color_palette, item1=color_palette_2, item2=color_palette_3)
code_block_11 = CodeBlock { 50; }
cycle = List.Cycle(list=create, amount=code_block_11)
shuffle = List.Shuffle(list=cycle)

byGeometryColor = Modifiers.GeometryColor.ByGeometryColor(geometry=translate, color=shuffle)
