# Dynamo graph DynamoLearnTutorial_02_AnatomyOfADefinition.dyn "02_AnatomyOfADefinition" (Dynamo 2.0.2.6826)

number = DoubleInput(3)
number_slider = DoubleSlider(43.5, range=0..100 step 0.1)
byCoordinates = Point.ByCoordinates(x=number, y=number, z=number_slider)
byPoint = ReferencePoint.ByPoint(pt=byCoordinates)
watch = Watch(byCoordinates)
