# Dynamo graph DynamoLearnTutorial_03_DataManagement.dyn "03_DataManagement" (Dynamo 2.0.2.6826)

integer_slider = IntegerSlider(4, range=0..100 step 1)
code_block = CodeBlock(a=integer_slider) { 2..#a..10; }
watch = Watch(code_block)
radiansToDegrees = Math.RadiansToDegrees(radians=watch)
sin = Math.Sin(angle=radiansToDegrees)
number = DoubleInput(0)
byCoordinates = Point.ByCoordinates(x=watch, y=sin, z=number, lacing=Longest)
watch_2 = Watch(code_block)
number_2 = DoubleInput(0)
number_3 = DoubleInput(5)
byCoordinates_2 = Point.ByCoordinates(x=watch_2, y=number_2, z=number_3, lacing=Longest)
byStartPointEndPoint = Line.ByStartPointEndPoint(startPoint=byCoordinates, endPoint=byCoordinates_2, lacing=Longest)
