# Dynamo graph DynamoLearnTutorial_04_NestedListManagement.dyn "04_NestedListManagement" (Dynamo 2.0.2.6826)

integer_slider = IntegerSlider(10, range=0..100 step 1)
code_block = CodeBlock(a=integer_slider) { 0..#a..1; }
integer_slider_2 = IntegerSlider(10, range=0..100 step 1)
code_block_2 = CodeBlock(a=integer_slider_2) { 0..#a..1; }
byCoordinates = Point.ByCoordinates(x=code_block, y=code_block_2, lacing=CrossProduct)
integer_slider_3 = IntegerSlider(9, range=0..100 step 1)
getItemAtIndex = List.GetItemAtIndex(list=byCoordinates, index=integer_slider_3)
number_slider = DoubleSlider(0.7, range=0..100 step 0.1)
byCenterPointRadius = Circle.ByCenterPointRadius(centerPoint=getItemAtIndex, radius=number_slider)
code_block_3 = CodeBlock { 4; }
regularPolygon = Polygon.RegularPolygon(circle=byCenterPointRadius, numberSides=code_block_3)
