# Dynamo graph DynamoLearnTutorial_05_ComputationalLogic1.dyn "05_ComputationalLogic1" (Dynamo 2.0.2.6826)

# group: Inputs for grid
x_count = IntegerSlider(11, range=0..100 step 1)
spacing = IntegerSlider(5, range=0..100 step 1)
y_count = IntegerSlider(11, range=0..100 step 1)

# group: Generate initial grid
code_block = CodeBlock(xCount=x_count, spacing=spacing) { 0..xCount..spacing; }
code_block_2 = CodeBlock(yCount=y_count, spacing=spacing) { 0..yCount..spacing; }
byCoordinates = Point.ByCoordinates(x=code_block, y=code_block_2, lacing=CrossProduct)

# group: Offset the grid
code_block_3 = CodeBlock { 0.5; }
mul = spacing * code_block_3
code_block_4 = CodeBlock(xCount=x_count, spacing=mul) { 0..xCount..spacing; }
code_block_5 = CodeBlock(yCount=y_count, spacing=mul) { 0..yCount..spacing; }
byCoordinates_2 = Point.ByCoordinates(x=code_block_4, y=code_block_5, lacing=CrossProduct)

list_create = List.Create(item0=byCoordinates, item1=byCoordinates_2)

# group: Revit sun settings
current = SunSettings()  # "SunSettings.Current"
sunDirection = SunSettings.SunDirection(sunSettings=current)

# group: Make circle, polygon and thicken to represent a panel
code_block_6 = CodeBlock { 1; }
byCenterPointRadiusNormal = Circle.ByCenterPointRadiusNormal(centerPoint=list_create, radius=code_block_6, normal=sunDirection)
code_block_7 = CodeBlock { 4; }
regularPolygon = Polygon.RegularPolygon(circle=byCenterPointRadiusNormal, numberSides=code_block_7)
byPatch = Surface.ByPatch(closedCurve=regularPolygon)
code_block_8 = CodeBlock { 0.1; }
thicken = Surface.Thicken(surface=byPatch, thickness=code_block_8)
