# Dynamo graph DynamoLearnTutorial_09_CodeBlocks.dyn "09_CodeBlocks" (Dynamo 2.0.2.6826)

# group: Designscript
code_block = CodeBlock { Point.ByCoordinates(5,0); }
code_block_2 = CodeBlock { Point.Origin(); }
origin = Point.Origin()
ZAxis = Vector.ZAxis()
code_block_3 = CodeBlock(pt=origin, vect=ZAxis) { pt.Add(vect); }

# group: Node versions
code_block_4 = CodeBlock { 5; }
byCoordinates = Point.ByCoordinates(x=code_block_4)
origin_2 = Point.Origin()
origin_3 = Point.Origin()
ZAxis_2 = Vector.ZAxis()
add = Point.Add(point=origin_3, vectorToAdd=ZAxis_2)
