# Dynamo graph DynamoLearnTutorial_10_CustomNodes.dyn "10_CustomNodes" (Dynamo 2.0.2.6826)

# group: Collect all rooms in the model for use as our values
categories = Categories(index=403)
all_elements_of_category = ElementsOfCategory(Category=categories)

# group: Get the room number for use as our keys
code_block = CodeBlock { "Number"; }
getParameterValueByName = Element.GetParameterValueByName(element=all_elements_of_category, parameterName=code_block)

# group: Initialize a dictionary object to store the data
byKeysValues = DesignScript.Builtin.Dictionary.ByKeysValues(keys=getParameterValueByName, values=all_elements_of_category)

# group: Retrieve the value (room) given the key (room number as a string)
code_block_2 = CodeBlock { "101"; }
valueAtKey = DesignScript.Builtin.Dictionary.ValueAtKey(dictionary=byKeysValues, key=code_block_2)
