# Dynamo graph DynamoLearnTutorial_7_RevitToExcel.dyn "7_RevitToExcel" (Dynamo 2.0.2.6826)

string = StringInput("C:\Users\johnpierson\Desktop\Dynamo Learn\7_Revit To Excel\7_RevitToExcel.xlsx")
string_2 = StringInput("RoomData")
code_block = CodeBlock { 0; }
categories = Categories(index=403)
all_elements_of_category = ElementsOfCategory(Category=categories)
id = Element.Id(element=all_elements_of_category)
name = Room.Name(room=all_elements_of_category)
list_create = List.Create(item0=id, item1=name)
exportExcel = Data.ExportExcel(filePath=string, sheetName=string_2, startRow=code_block, startCol=code_block, data=list_create)
