# Dynamo graph DynamoLearnTutorial_8_ExcelToRevit.dyn "8_ExcelToRevit" (Dynamo 2.0.2.6826)

file_path = Filename("C:\Users\johnpierson\Desktop\Dynamo Learn\7_Revit To Excel\7_RevitToExcel.xlsx")
file_from_path = FileObject(path=file_path)
code_block = CodeBlock { "RoomData"; false; }
importExcel = Data.ImportExcel(file=file_from_path, sheetName=code_block.out0, showExcel=code_block.out1)
code_block_2 = CodeBlock { 0; 1; }
getItemAtIndex = List.GetItemAtIndex(list=importExcel, index=code_block_2.out0)
code_block_3 = CodeBlock(id=getItemAtIndex) { Revit.ElementSelector.ByElementId(id); }
string = StringInput("Name")
getItemAtIndex_2 = List.GetItemAtIndex(list=importExcel, index=code_block_2.out1)
setParameterByName = Element.SetParameterByName(element=code_block_3, parameterName=string, value=getItemAtIndex_2)
