# Dynamo graph DynamoLearnTutorial_Column Size Script_Computational Logic II.dyn "Column Size Script_Computational Logic II" (Dynamo 2.0.0.4654)

# group: To Revit
# note: For changes made to Revit

# group: Annotation
# note: For notes and titles

# group: Control
# note: For sliders and other options

# group: Input
# note: For selection and whatnot

# group: Background
# note: For workflow

# group: Family Types to be used
family_types = FamilyTypes()  # nothing selected
family_types_2 = FamilyTypes()  # nothing selected
family_types_3 = FamilyTypes()  # nothing selected
list_create = List.Create(item0=family_types, item1=family_types_2, item2=family_types_3)

# group: The grid of points to place columns by
code_block = CodeBlock()
# ---------- code_block.designscript (2 lines) ----------
//start..amount..spacing
0..#10..6;
# ----------------------------------------
byCoordinates = Point.ByCoordinates(x=code_block, y=code_block, lacing=CrossProduct)

# group: Attractor Point
number_slider = DoubleSlider(3.658, range=0..100 step 0.1)
number_slider_2 = DoubleSlider(27.282, range=-24.09..100 step 0.1)
byCoordinates_2 = Point.ByCoordinates(x=number_slider, y=number_slider_2, lacing=CrossProduct)

# group: Calculate the distance to the attractor and remap to a range within our indexes
distanceTo = Geometry.DistanceTo(geometry=byCoordinates, other=byCoordinates_2)
code_block_2 = CodeBlock { 0; }
count = List.Count(list=list_create)
code_block_3 = CodeBlock { 0.01; }
sub = count - code_block_3
remapRange = Math.RemapRange(numbers=distanceTo, newMin=code_block_2, newMax=sub)
floor = Math.Floor(number=remapRange)

# group: Calculate the Heights based on smallest and largest
code_block_4 = CodeBlock { 5; 10; }
remapRange_2 = Math.RemapRange(numbers=distanceTo, newMin=code_block_4.out0, newMax=code_block_4.out1)

# group: Get the family types to place, place them in Revit and set the Height Parameter.
getItemAtIndex = List.GetItemAtIndex(list=list_create, index=floor)
byPoint = FamilyInstance.ByPoint(familyType=getItemAtIndex, point=byCoordinates)
code_block_5 = CodeBlock { "Height"; }
setParameterByName = Element.SetParameterByName(element=byPoint, parameterName=code_block_5, value=remapRange_2)
