# Dynamo graph DynamoLearnTutorial_Getting Started with Dynamo.dyn "Getting Started with Dynamo" (Dynamo 2.0.2.6826)

# note: View -> Background 3D Preview On/Off:
# Show/Hide geometry preview in the Dynamo Workspace
# note: Number:
# Create a Number
number = DoubleInput(0)  # graph input
# note: Point By Coordinates:
# Form a Point by 3 Cartesian Coordinates
byCoordinates = Point.ByCoordinates(x=number, y=number, z=number)
# note: Watch Node:
# Visualize the output of a node
watch = Watch(byCoordinates)
watch_3d = Watch3D(byCoordinates)
