# Dynamo graph Exercise 1.dyn (Dynamo 2.2.1.5175)

file_path = Filename("C:\Users\ThomasMahon\Documents\DynamoWorkshops\2019\Dynamo for Software Developers\Session 1 IronPython Basics\Execrcise 1.py")
file_from_path = FileObject(path=file_path)
readText = FileSystem.ReadText(file=file_from_path)
select_model_elements = DSModelElementsSelection()  # 6 picked in the model
python_script_from_string = PythonStringNode(script=readText, IN[0]=select_model_elements)
