# Dynamo graph Exercise 2.dyn (Dynamo 2.2.1.5175)

file_path = Filename("..\Exercise 2.py")
file_from_path = FileObject(path=file_path)
readText = FileSystem.ReadText(file=file_from_path)
select_model_elements = DSModelElementsSelection()  # 8 picked in the model
select_model_element = DSModelElementSelection()  # 1 picked in the model
getFamily = FamilyInstance.GetFamily(familyInstance=select_model_elements)
string = StringInput("0915mm Diameter")
byFamilyAndName = FamilyType.ByFamilyAndName(family=getFamily, name=string)
firstItem = List.FirstItem(list=byFamilyAndName)
string_2 = StringInput("Radius")
getParameterValueByName = Element.GetParameterValueByName(element=firstItem, parameterName=string_2)
python_script_from_string = PythonStringNode(script=readText, IN[0]=select_model_elements, IN[1]=select_model_element, IN[2]=getParameterValueByName)
area = Room.Area(room=select_model_element)
